# Grasshopper definition Tower.gh (Grasshopper 1.0.8)
# plug-ins: eleFront5, Wombat

m_objects = QueryModelObjects(Layer="02_Tower_Base", Locked=True, Hidden=True, AutoUpdateState=True)
crv = Curve(m_objects)
explode = Explode(Curve=crv, Recursive=True)  # -> Segments, Vertices
area = Area(Geometry=crv)  # -> Area, Centroid
item = ListItem(List=explode.Segments, Index=0, Wrap=True)
mp = Midpoint(Curve=item)
ln = Line(StartPoint=area.Centroid, EndPoint=mp)
pl = ConstructPlane(Origin=area.Centroid, XAxis=ln, YAxis=Vector(0, 1, 0))
number_slider = Slider(19.8, range=15..30)
number_slider_2 = Slider(15, range=15..30)
dom = ConstructDomain(DomainStart=expr("-x", number_slider), DomainEnd=number_slider)
dom_2 = ConstructDomain(DomainStart=expr("-x", number_slider_2), DomainEnd=number_slider_2)
rectangle = Rectangle(Plane=pl, XSize=dom, YSize=dom_2, Radius=0)  # -> Rectangle, Length

bottom_width = Slider(0.81, range=0..1)
upper_width = Slider(0.563, range=0..1)
dom_3 = ConstructDomain(DomainStart=bottom_width, DomainEnd=upper_width)

ftf_height = Slider(3.8, range=2.9..5)
floor_count = Slider(36, range=5..70)
tower_twist = Slider(2.8, range=0..5)

# ---- group: TYPOLOGY MIX
coef_1 = Slider(0.856, range=0..1)
coef_2 = Slider(0.62, range=0..1)
coef_3 = Slider(0.236, range=0..1)
coef_4 = Slider(0, range=0..1)

# ----
series = Series(Start=0, Step=ftf_height, Count=floor_count)
series_2 = Series(Start=0, Step=tower_twist, Count=floor_count)
Z = UnitZ(Factor=series)
move = Move(Geometry=rectangle.Rectangle, Motion=Z)  # -> Geometry, Transform
area_2 = Area(Geometry=move.Geometry)  # -> Area, Centroid
lng = ListLength(List=area_2.Centroid)
range = Range(Domain=Domain(0, 1), Steps=expr("x-1", lng))
tower_deflection = GraphMapper(
    range,
    x0=0,
    x1=1,
    y0=0,
    y1=1,
    container_name="Bezier",
    cpx=[0, 0.738173306, 0.605435133, 1],
    cpy=[0.2548726201, 0.008803665638, 0.06793481112, 1])
crv_2 = Curve(move.Geometry)
remap = RemapNumbers(Value=tower_deflection, Source=Domain(0, 1), Target=dom_3)  # -> Mapped, Clipped
scale = Scale(Geometry=crv_2, Center=area_2.Centroid, Factor=remap.Mapped)  # -> Geometry, Transform
num = Number(series_2)
rotate = Rotate(Geometry=scale.Geometry, Angle=degrees(num), Plane=area_2.Centroid)  # -> Geometry, Transform
boundary = BoundarySurfaces(Edges=rotate.Geometry)
Z_2 = UnitZ(Factor=ftf_height)
crv_3 = Curve([<curve referenced from the Rhino model> x3])
extr = Extrude(Base=boundary, Direction=Z_2)
number_slider_3 = Slider(4, range=0..10)
loft = Loft(Curves=crv_3, Options={Adjust=False, Closed=False, LoftEnds=0, LoftSimp=0, LoftType=3, Rebuild=10, Refit=0.01})
contour = Contour(Shape=loft, Point=Point(0, 0, 0), Direction=Vector(0, 0, 1), Distance=number_slider_3)
boundary_2 = BoundarySurfaces(Edges=contour)
Z_3 = UnitZ(Factor=number_slider_3)
extr_2 = Extrude(Base=boundary_2, Direction=Z_3)  # -> flatten(Extrusion)
cluster = Cluster(V=coef_1, L=extr_2)
cluster_2 = Cluster(V=coef_2, L=extr_2)
cluster_3 = Cluster(V=coef_3, L=extr_2)
cluster_4 = Cluster(V=coef_4, L=extr_2)
py3 = Python3Script(data=extr_2, i1=cluster, i2=cluster_2, i3=cluster_3, i4=cluster_4)  # -> out1, out2, out3, out4; inputs data: list
# ---------- py3: Python ----------
indices = sorted([int(i1), int(i2), int(i3)])

indices = [max(0, min(len(data), i)) for i in indices]


out1 = data[:indices[0]]
out2 = data[indices[0]:indices[1]]
out3 = data[indices[1]:indices[2]]
out4 = data[indices[2]:]
# ---------- end py3 ----------
swatch = ColourSwatch(SwatchColor=RGBA(212, 207, 199, 154))
swatch_2 = ColourSwatch(SwatchColor=RGBA(133, 133, 133, 154))
swatch_3 = ColourSwatch(SwatchColor=RGBA(176, 176, 176, 154))
swatch_4 = ColourSwatch(SwatchColor=RGBA(219, 219, 219, 154))
preview = CustomPreview(Geometry=py3.out1, Material="#EA8C16")
preview_2 = CustomPreview(Geometry=py3.out2, Material="#5B7DA6")
preview_3 = CustomPreview(Geometry=py3.out3, Material="#D6524F")
preview_4 = CustomPreview(Geometry=py3.out4, Material="#78A9A5")
data = Data(simplify(graft(extr_2)))
tstat = TreeStatistics(Tree=data)  # -> Paths, Length, Count
data_2 = Data(simplify(data))
debrep = DeconstructBrep(Brep=data_2)  # -> Faces, Edges, Vertices
panel = Panel("""Floor
Type
GFA
Facade Area""")
area_3 = Area(Geometry=debrep.Faces)  # -> Area, Centroid
pdecon = Deconstruct(Point=area_3.Centroid)  # -> XComponent, YComponent, ZComponent
join = TextJoin(Text=panel, Join="_")
lng_2 = ListLength(List=py3.out1)
lng_3 = ListLength(List=py3.out2)
lng_4 = ListLength(List=py3.out3)
lng_5 = ListLength(List=py3.out4)
sort = SortList(Keys=pdecon.ZComponent, ValuesA=debrep.Faces)  # -> Keys, ValuesA
dup = DuplicateData(Data=join, Number=tstat.Count, Order=True)  # -> graft(Data)
panel_2 = Panel("""0
-1""")
dup_2 = DuplicateData(Data="Retail", Number=lng_2, Order=True)
dup_3 = DuplicateData(Data="Office", Number=lng_3, Order=True)
dup_4 = DuplicateData(Data="Hospitality", Number=lng_4, Order=True)
dup_5 = DuplicateData(Data="Hotel", Number=lng_5, Order=True)
item_2 = ListItem(List=sort.ValuesA, Index=0, Wrap=True)  # -> simplify(Item)
cull_i = CullIndex(List=sort.ValuesA, Indices=panel_2, Wrap=True)
tstat_2 = TreeStatistics(Tree=data_2)  # -> Paths, Length, Count
split = TextSplit(Text=dup, Separators="_")  # -> simplify(Result)
merge = Merge(Data1=dup_2, Data2=dup_3, Data3=dup_4, Data4=dup_5)  # -> graft(Result)
area_4 = Area(Geometry=cull_i)  # -> Area, Centroid
data_3 = Data(split)
series_3 = Series(Start=0, Step=1, Count=tstat_2.Count)  # -> graft(Series)
ma = MassAddition(Input=area_4.Area)  # -> simplify(Result), PartialResults
area_5 = Area(Geometry=item_2)  # -> Area, Centroid
int = Integer(area_5.Area)
int_2 = Integer(ma.Result)
merge_2 = Merge(Data1=simplify(series_3), Data2=simplify(merge), Data3=simplify(int), Data4=simplify(int_2))
ma_2 = MassAddition(Input=flatten(area_5.Area))  # -> Result, PartialResults
panel_3 = Panel(data_3)
panel_4 = Panel(merge_2)
panel_5 = Panel(ma_2.Result)
item_3 = ListItem(List=merge_2, Index=0, Wrap=True)
item_4 = ListItem(List=merge_2, Index=0, Wrap=True)  # -> Item, Item1
item_5 = ListItem(List=merge_2, Index=0, Wrap=True)  # -> Item, Item1, Item2
concat = Concatenate(FragmentA="FLR-", FragmentB=item_3)
names = EleFrontDataDescription(flatten(item_3), ShiftDepth=0, isNameSet=True)
parent = EleFrontDataDescription(flatten(item_4.Item1), ShiftDepth=0, isNameSet=True)
area_6 = EleFrontDataDescription(flatten(item_5.Item2), ShiftDepth=0, isNameSet=True)
panel_6 = Panel(parent)
crv_4 = Curve([<curve referenced from the Rhino model> x15])
crv_5 = Curve(crv_4)
lng_6 = ListLength(List=crv_5)
area_7 = Area(Geometry=crv_5)  # -> Area, Centroid
charseq = CharSequence(Count=lng_6, CharPool="ABCDEFGHIJKLMNOPQRSTUVWXYZ", Format="{0}")
num_2 = Number(area_7.Area)
concat_2 = Concatenate(FragmentA="Zone-", FragmentB=charseq)
partition = PartitionList(List=concat_2, Size=Slider(3, range=0..10))
long = LongestList(ListB=partition, PaddingMode=3)  # -> flatten(ListA), ListB
list = ValueList({"treemap", "bar", "pack", "pie", "sankey", "sunburst"}, selected="treemap")
viewport = Python3Script(
    chart_type=list,
    parents=parent,
    names=names,
    values=area_6,
    trigger=Button(),
    w=Slider(694, range=0..1000),
    enable=Toggle(True))  # -> out, a; inputs parents: list, names: list, values: list
# ---------- viewport: Python ----------
"""
GH Dashboard — Viewport (Final)
INPUTS:
  names      - List str
  values     - List float
  parents    - List str (optional)
  chart_type - Item str ("treemap", "bar", "pack", "radial", "sankey")
  title      - Item str
  subtitle   - Item str
  trigger    - Item any
  enable     - Item bool
  x, y       - Item int
  w          - Item int
"""

import json, os, datetime, threading, traceback
import scriptcontext as sc
import Rhino
import Rhino.Display as rd
import System.Drawing as sd
import System.IO
import System
from http.server import HTTPServer, SimpleHTTPRequestHandler

SERVE_DIR   = r"D:\00_HS\GSS24\code\New folder\datacharts\mvp"
OUTPUT_JSON = os.path.join(SERVE_DIR, "gh_dashboard.json")
PORT        = 8080
URL         = "http://localhost:{}".format(PORT)

out = "starting..."

try:
    _names      = globals().get("names")   or[]
    _values     = globals().get("values")  or []
    _parents    = globals().get("parents") or[]
    _chart_type = str(globals().get("chart_type") or "treemap").lower()
    _title      = str(globals().get("title") or "Grasshopper Dashboard")
    _subtitle   = str(globals().get("subtitle") or "Live Data Feed")
    _font_scale = float(globals().get("font_scale") or 1.0)
    _enable     = globals().get("enable",  True)
    _x          = int(globals().get("x") or 20)
    _y          = int(globals().get("y") or 60)
    _w          = int(globals().get("w") or 500)

    sc.sticky["GH_VP_ENABLED"] = bool(_enable)
    sc.sticky["GH_VP_X"]       = _x
    sc.sticky["GH_VP_Y"]       = _y
    sc.sticky["GH_VP_W"]       = _w

    # firing up the server
    if "GH_VP_STARTED" not in sc.sticky:
        class _H(SimpleHTTPRequestHandler):
            def __init__(self, *a, **kw):
                super().__init__(*a, directory=SERVE_DIR, **kw)
            def do_POST(self):
                if self.path == "/screenshot":
                    n = int(self.headers.get("Content-Length", 0))
                    sc.sticky["GH_VP_PNG_BYTES"] = self.rfile.read(n)
                    self.send_response(200)
                    self.end_headers()
                    sc.sticky["GH_VP_NEEDS_REDRAW"] = True
                else:
                    self.send_response(404)
                    self.end_headers()
            def end_headers(self):
                self.send_header("Cache-Control", "no-cache, no-store, must-revalidate")
                super().end_headers()
            def log_message(self, *a): pass

        threading.Thread(target=lambda: HTTPServer(("", PORT), _H).serve_forever(), daemon=True).start()

        import Eto.Forms as ef, Eto.Drawing as ed
        _wv           = ef.WebView()
        _wv.Url       = System.Uri(URL)
        _form         = ef.Form()
        _form.Title   = "GH Dashboard"
        _form.Size    = ed.Size(1100, 750)
        _form.Content = _wv
        _form.Show()

        sc.sticky["GH_VP_STARTED"] = True
        sc.sticky["GH_VP_FORM"]    = _form

    # safe guard bitmap updates
    if "GH_VP_IDLE" not in sc.sticky:
        def _idle(sender, e):
            if sc.sticky.get("GH_VP_NEEDS_REDRAW"):
                sc.sticky["GH_VP_NEEDS_REDRAW"] = False
                data = sc.sticky.get("GH_VP_PNG_BYTES")
                if data:
                    try:
                        ms  = System.IO.MemoryStream(System.Array[System.Byte](data))
                        raw = sd.Bitmap(ms)
                        
                        old_bmp = sc.sticky.get("GH_VP_BMP")
                        if old_bmp:
                            try: old_bmp.Dispose()
                            except: pass
                            
                        new_bmp = sd.Bitmap(raw)
                        sc.sticky["GH_VP_BMP"] = rd.DisplayBitmap(new_bmp)
                        raw.Dispose()
                        ms.Dispose()
                    except Exception as ex:
                        sc.sticky["GH_VP_ERR"] = str(ex)
                Rhino.RhinoDoc.ActiveDoc.Views.Redraw()

        Rhino.RhinoApp.Idle += _idle
        sc.sticky["GH_VP_IDLE"] = _idle

    # handler
    if "GH_VP_CH" in sc.sticky:
        try:    rd.DisplayPipeline.DrawForeground -= sc.sticky["GH_VP_CH"]
        except: pass
        del sc.sticky["GH_VP_CH"]

    def _draw(sender, e):
        if not sc.sticky.get("GH_VP_ENABLED", True): return
        try:
            bmp = sc.sticky.get("GH_VP_BMP")
            if bmp: e.Display.DrawBitmap(bmp, sc.sticky.get("GH_VP_X", 20), sc.sticky.get("GH_VP_Y", 60))
        except Exception as ex:
            sc.sticky["GH_VP_ERR"] = str(ex)

    rd.DisplayPipeline.DrawForeground += _draw
    sc.sticky["GH_VP_CH"] = _draw

    #json making
    if _names and _values and len(_names) == len(_values):
        _parents = (_parents + [""] * len(_names))[:len(_names)]
        rows =[{"name": str(n), "value": float(v), **({"parent": str(p)} if p else {})}
                for n, v, p in zip(_names, _values, _parents) if n is not None and v is not None]
        
        payload = {
            "updated": datetime.datetime.now().strftime("%Y-%m-%d %H:%M:%S"),
            "config": {
                "type": _chart_type,
                "title": _title,
                "subtitle": _subtitle,
                "w": _w,
                "font_scale": _font_scale
            },
            "data": rows
        }
        
        with open(OUTPUT_JSON, "w") as f:
            json.dump(payload, f, indent=2)
            
        out = "OK | {} rows | {} | overlay:{}".format(len(rows), _chart_type.upper(), "ON" if _enable else "OFF")
    else:
        out = "waiting for data"

except Exception:
    out = "ERROR: " + traceback.format_exc()
# ---------- end viewport ----------
panel_7 = Panel(viewport.out)

# ==== cluster Cluster
L = ClusterInput()
lng = ListLength(List=L)
V = ClusterInput()
dom = ConstructDomain(DomainStart=0, DomainEnd=lng)
remap = RemapNumbers(Value=V, Source=Domain(0, 1), Target=dom)  # -> Mapped, Clipped
int = Integer(remap.Mapped)
int_2 = ClusterOutput(int)
