# Grasshopper definition Local Testing.gh (Grasshopper 1.0.8)

# DATA MUNCHER EXAMPLE
panel = Panel("""INDUSTRIAL
OFFICE
RESIDENTIAL""")
number_slider = Slider(28, range=0..100)
number_slider_2 = Slider(28, range=0..100)
number_slider_3 = Slider(4, range=0..10)
series = Series(Start=0, Step=1, Count=number_slider)
charseq = CharSequence(Count=number_slider, CharPool="ABCDEFGHIJKLMNOPQRSTUVWXYZ", Format="{0}")
wheel = ColourWheel(
    number_slider,
    ColourGrips_Style=31,
    ColourGrips_Grip=[5.3561576, 1.167367395, 3.261762498, 2.214564947],
    ColourGrips_Lum=[0.7005135525, 0.9522640428],
    ColourGrips_Range=[0.5063643579, 0.5063643579, 0.5063643579, 0.5063643579],
    ColourGrips_Sat=[0.1329461238, 0.2553713948])
number_slider_4 = Slider(3, range=0..10)
swatch = ColourSwatch(SwatchColor=RGB(130, 192, 196))
swatch_2 = ColourSwatch(SwatchColor=RGB(118, 94, 189))
swatch_3 = ColourSwatch(SwatchColor=RGB(199, 115, 74))
number_slider_5 = Slider(20, range=0..100)
entwine = Entwine(
    Branch00=[ColourSwatch(SwatchColor=RGB(204, 225, 227)), swatch],
    Branch01=[ColourSwatch(SwatchColor=RGB(192, 182, 219)), swatch_2],
    Branch02=[ColourSwatch(SwatchColor=RGB(214, 188, 176)), swatch_3],
    FlattenInputs=True)
py3 = Python3Script(data=charseq, n=number_slider_4)  # -> out, partitions; inputs data: tree
# ---------- py3: Python ----------
"""
List Partitioner - Grasshopper Script Component

Splits a flat list or DataTree into N equal branches.
For DataTree input, each branch is partitioned independently into N sub-branches.
If the item count is not evenly divisible by N, the last branch gets the remainder.

INPUTS:
  data : DataTree / List  - items to partition
  n    : int              - number of output partitions per branch

OUTPUTS:
  out  : DataTree         - partitioned data, one branch per partition
  info : str              - summary message
"""

import math
import System
import Grasshopper
from Grasshopper import DataTree
from Grasshopper.Kernel.Data import GH_Path

partitions = DataTree[object]()
info = ""

# ── helpers ───────────────────────────────────────────────────────────────────

def _is_tree(x):
    return x is not None and hasattr(x, "Branches") and hasattr(x, "Paths")


def _partition(items, n):
    """Split a list into n chunks. Last chunk may be smaller."""
    total = len(items)
    if n <= 0 or total == 0:
        return []
    chunk_size = math.ceil(total / n)
    chunks = []
    for i in range(n):
        start = i * chunk_size
        if start >= total:
            break
        chunks.append(items[start : start + chunk_size])
    return chunks


def _make_path(*indices):
    """Build a GH_Path from a sequence of ints."""
    arr = System.Array[int](list(indices))
    return GH_Path(arr)


# ── main ──────────────────────────────────────────────────────────────────────

try:
    _n = int(n) if n is not None else 1
    if _n < 1:
        _n = 1

    total_items   = 0
    total_branches = 0

    if _is_tree(data):
        # each existing branch gets split into _n sub-branches
        for path, branch in zip(data.Paths, data.Branches):
            items  = [i for i in branch if i is not None]
            chunks = _partition(items, _n)
            base   = list(path.Indices)
            for idx, chunk in enumerate(chunks):
                new_path = _make_path(*(base + [idx]))
                for item in chunk:
                    partitions.Add(item, new_path)
            total_items   += len(items)
            total_branches += len(chunks)

    elif data is not None:
        # flat list → split into _n top-level branches {0}, {1}, …
        items  = [i for i in data if i is not None]
        chunks = _partition(items, _n)
        for idx, chunk in enumerate(chunks):
            path = _make_path(idx)
            for item in chunk:
                partitions.Add(item, path)
        total_items   = len(items)
        total_branches = len(chunks)

    if total_items > 0:
        info = "OK | {} items → {} branches".format(total_items, total_branches)
    else:
        info = "waiting for data..."

except Exception as ex:
    import traceback
    info = "ERROR: " + traceback.format_exc()
# ---------- end py3 ----------
parition_data = Python3Script(data=wheel, n=number_slider_4)  # -> out, partitions; inputs data: tree; same code as py3
py3_2 = Python3Script(data=series, n=number_slider_4)  # -> out, partitions; inputs data: tree; same code as py3
lng = ListLength(List=py3_2.partitions)
tween_colors = Python3Script(colors=entwine, count=lng)  # -> out, gradient; inputs colors: tree, count: tree
# ---------- tween_colors: Python ----------
"""
GH Color Tween
Interpolates between input colours to produce a smooth gradient list.

INPUTS:
  colors  - DataTree / List Color  — gradient stop colours per branch
  count   - Item / List int        — number of output colours
                                     single value  → applied to every branch
                                     list / tree   → one per branch
OUTPUT:
  a       - DataTree / List Color  — interpolated result (same tree structure as input)
"""

import System.Drawing as sd
import traceback

# ── helpers ───────────────────────────────────────────────────────────────────

def _is_tree(x):
    return x is not None and hasattr(x, 'Branches') and hasattr(x, 'Paths')

def _lerp_color(c1, c2, t):
    return sd.Color.FromArgb(
        int(round(c1.A + (c2.A - c1.A) * t)),
        int(round(c1.R + (c2.R - c1.R) * t)),
        int(round(c1.G + (c2.G - c1.G) * t)),
        int(round(c1.B + (c2.B - c1.B) * t))
    )

def _tween(stops, n):
    stops = [s for s in stops if s is not None]
    if not stops or n <= 0: return []
    if n == 1:              return [stops[0]]
    if len(stops) == 1:     return [stops[0]] * n
    result = []
    for i in range(n):
        t   = i / (n - 1)
        seg = t * (len(stops) - 1)
        idx = min(int(seg), len(stops) - 2)
        result.append(_lerp_color(stops[idx], stops[idx + 1], seg - idx))
    return result

# ── main ──────────────────────────────────────────────────────────────────────

gradient = []

try:
    _colors = globals().get("colors")
    _count  = globals().get("count")

    # normalise count → flat list (one int per branch, or single broadcast value)
    if   _count is None:                                       counts = []
    elif isinstance(_count, (int, float)):                     counts = [int(_count)]
    elif _is_tree(_count):
        counts = [int(i) for b in _count.Branches for i in b if i is not None]
    else:
        counts = [int(i) for i in _count if i is not None]

    def _get_n(branch_idx):
        if not counts:           return 10
        if len(counts) == 1:     return counts[0]
        return counts[branch_idx] if branch_idx < len(counts) else counts[-1]

    if _is_tree(_colors):
        import Grasshopper as gh
        out_tree = gh.DataTree[sd.Color]()
        for i, (path, branch) in enumerate(zip(_colors.Paths, _colors.Branches)):
            for c in _tween(list(branch), _get_n(i)):
                out_tree.Add(c, path)
        gradient = out_tree
    else:
        stops = [c for c in (_colors or []) if c is not None]
        gradient = _tween(stops, _get_n(0))

except Exception:
    gradient = []
# ---------- end tween_colors ----------
tstat = TreeStatistics(Tree=py3.partitions)  # -> Paths, Length, Count
merge = Merge(Data1=swatch, Data2=swatch_2, Data3=swatch_3)
long = LongestList(ListA=panel, ListB=tstat.Paths, PaddingMode=3)  # -> ListA, ListB
graft = GraftTree(Tree=merge, IncludeEmptyLists=True, IncludeNullItems=True)
graft_2 = GraftTree(Tree=long.ListA, IncludeEmptyLists=True, IncludeNullItems=True)
list = ValueList({"treemap", "pack", "bar", "sunburst", "sankey"}, selected="treemap")
horizontal_position = Slider(31, range=1..1000)
vertical_position = Slider(30, range=1..1000)
chart_size = Slider(587, range=0..1000)
# TOGGLE TESTING BEFORE DEPLOYING
data_muncher = Python3Script(
    chart_type=list,
    labels=py3.partitions,
    values=py3_2.partitions,
    groups=graft_2,
    item_colors=tween_colors.gradient,
    group_colors=graft,
    title="DASHBOARD",
    subtitle="Data Visualization",
    units="m²",
    position_x=horizontal_position,
    position_y=vertical_position,
    chart_size=chart_size,
    font_scale=Slider(1.2, range=0..2),
    viewport="Perspective",
    enable=Toggle(True))  # -> out, a; inputs labels: tree, values: tree, groups: tree, item_colors: tree, group_colors: tree
#   port chart_type: [string] - Type one of: treemap, bar, pie, sunburst, sankey. Defaults to treemap if left blank
#   port labels: Connect a list of values parallel to data points.This input accepts both flat lists and datatrees
#   port values: Connect a list of values parallel to data points. This input accepts both flat lists and datatrees
#   port groups: Connect a flat list for data groups or a group per each data branch. Leave empty or disconnected for a flat (ungrouped) chart
#   port item_colors: Assign a color per each data point.This input accepts both flat lists and datatrees
#   port title: Add any string for the Chart Title
#   port subtitle: Add any string for the Chart Subtitle
#   port units: Any string, e.g. m², kg, hrs. Defaults to m²
#   port position_x: Horizontal pixel offset of the overlay image from the left edge of the Rhino viewport. Integer. Defaults to 20
#   port position_y: Vertical pixel offset of the overlay image from the top edge of the Rhino viewport. Integer. Defaults to 60
#   port chart_size: Controls the size of the bitmap inside the Rhino viewport
#   port font_scale: A global multiplier applied to every font size in the chart.
#   port viewport: The name or names of the Rhino viewports that should display the overlay. Connect a text panel with one viewport name per line, e.g. Perspective
#   port enable: Toggles the charts overlay on or off
# ---------- data_muncher: Python ----------
"""
Data Muncher - Grasshopper Dashboard Component
Rhino 8 Script Component

INPUTS:
  labels      : DataTree / List str    - display labels
  values     : DataTree / List float  - numeric values
  groups    : DataTree / List str    - grouping category (optional)
               Case A: same branch count & item count as names/values → 1-to-1
               Case B: same branch count, 1 item per branch → broadcast
  item_colors     : DataTree / List Color  - per-item colours (optional, same Cases A/B)
  group_colors : DataTree / List Color - per-group colours (optional, same Cases A/B)
  chart_type : str   - treemap | bar | pack | sunburst | sankey
  title      : str
  subtitle   : str
  units      : str   - value units label (default: m²)
  enable     : bool  - show viewport overlay
  position_x : int   - viewport overlay X
  position_y : int   - viewport overlay Y
  chart_size : int   - export bitmap width (px)
  font_scale : float
  viewport   : str   - Rhino viewport name (blank = Perspective)
  trigger    : object

OUTPUTS:
  a          : str   - status message
"""

a = "initializing..."

_PFX = "DMUNCH_"

# set this to true to serve files straight from your repo web folder
use_dev_web = False

# this is only used when use_dev_web is true
dev_web_dir = r"D:\00_HS\GSS24\code\New folder\datacharts\web"

try:
    import json, os, datetime, threading, traceback, tempfile, hashlib
    import scriptcontext as sc
    import Rhino
    import Rhino.Display as rd
    import System.Drawing as sd
    import System.IO
    import System
    import Grasshopper
    from http.server import HTTPServer, SimpleHTTPRequestHandler
except Exception as ex:
    a = "IMPORT ERROR: " + str(ex)
    raise


def _get_doc_dir():
    try:
        doc = ghenv.Component.OnPingDocument()
        if doc and doc.FilePath:
            return os.path.dirname(doc.FilePath)
    except:
        pass
    return None


def _find_web_source(extra=None):
    candidates = []
    if extra:
        candidates.append(str(extra))

    try:
        for lib in Grasshopper.Instances.ComponentServer.Libraries:
            name = (lib.Name or "").lower()
            if "data_muncher" in name or "datamuncher" in name:
                root = os.path.dirname(lib.Location)
                candidates.append(os.path.join(root, "shared"))
                candidates.append(os.path.join(root, "web"))
                candidates.append(root)
    except:
        pass

    try:
        asm = ghenv.Component.GetType().Assembly.Location
        if asm:
            root = os.path.dirname(asm)
            candidates.append(os.path.join(root, "shared"))
            candidates.append(os.path.join(root, "web"))
            candidates.append(root)
    except:
        pass

    doc_dir = _get_doc_dir()
    if doc_dir:
        candidates.append(os.path.join(doc_dir, "web"))
        candidates.append(os.path.abspath(os.path.join(doc_dir, "..", "web")))

    cwd = os.getcwd()
    candidates.append(os.path.join(cwd, "web"))
    candidates.append(cwd)

    for path in candidates:
        try:
            full = os.path.abspath(path)
            if os.path.isdir(full) and os.path.isfile(os.path.join(full, "index.html")):
                return full
        except:
            pass

    raise Exception("could not find source web folder")


def _get_temp_dir(port):
    d = os.path.join(tempfile.gettempdir(), "data_muncher", str(port))
    os.makedirs(d, exist_ok=True)
    return d


def _find_icon_file():
    candidates = []

    try:
        asm = ghenv.Component.GetType().Assembly.Location
        if asm:
            root = os.path.dirname(asm)
            candidates.append(os.path.join(root, "assets", "data_muncher.png"))
            candidates.append(os.path.join(root, "shared", "data_muncher.png"))
            candidates.append(os.path.join(root, "shared", "assets", "data_muncher.png"))
    except:
        pass

    cwd = os.getcwd()
    candidates.append(os.path.join(cwd, "assets", "data_muncher.png"))
    candidates.append(os.path.join(cwd, "data_muncher.png"))

    for path in candidates:
        try:
            full = os.path.abspath(path)
            if os.path.isfile(full):
                return full
        except:
            pass

    return None


# ── DataTree helpers ──────────────────────────────────────────────────────────

def _is_tree(x):
    return x is not None and hasattr(x, 'Branches') and hasattr(x, 'Paths')

def _tree_branches(x):
    """DataTree → ordered list of (path_str, [non-None items])"""
    return [(str(p), [i for i in b if i is not None])
            for p, b in zip(x.Paths, x.Branches)]

def _flat_branches(x):
    """Flat list → [("flat", [non-None items])]"""
    return [("flat", [i for i in (x or []) if i is not None])]

def _color_to_hex(c):
    try:    return "#{:02x}{:02x}{:02x}".format(int(c.R), int(c.G), int(c.B))
    except: return None


def _branch_map(raw):
    if _is_tree(raw):
        branches = _tree_branches(raw)
    elif raw:
        branches = _flat_branches(raw)
    else:
        branches = []
    return branches, dict(branches)


def _empty_stats():
    return {
        "skipped_rows": 0,
        "errors": [],
    }


def _make_payload(chart_type, title, subtitle, units, width, font_scale, rows, error=None):
    config = {
        "type":       chart_type,
        "title":      title,
        "subtitle":   subtitle,
        "units":      units,
        "w":          width,
        "font_scale": font_scale,
    }
    content_hash = hashlib.md5(
        json.dumps({"config": config, "data": rows, "error": error}, sort_keys=True).encode()
    ).hexdigest()[:12]
    return {
        "updated": content_hash,
        "error": error,
        "config": config,
        "data": rows,
    }

def build_rows(names_raw, values_raw, parents_raw, colors_raw=None, group_colors_raw=None):
    """Always yields leaf-level rows {name, value, ?parent, ?color}.

    Parent/color matching per branch:
      Case A – same item count as names/values → 1-to-1
      Case B – exactly 1 item per branch       → broadcast to all items
    """
    n_branches = _tree_branches(names_raw)  if _is_tree(names_raw)  else _flat_branches(names_raw)
    v_branches = _tree_branches(values_raw) if _is_tree(values_raw) else _flat_branches(values_raw)

    _p_branches, p_map = _branch_map(parents_raw)
    _c_branches, c_map = _branch_map(colors_raw)
    _g_branches, g_map = _branch_map(group_colors_raw)

    v_map = dict(v_branches)
    rows  = []
    stats = _empty_stats()

    def _resolve(raw, count, to_str=True):
        """Apply Case A / Case B / empty for any optional per-branch list."""
        if len(raw) == 1:       return ([str(raw[0])] if to_str else [raw[0]]) * count
        elif len(raw) >= count: return ([str(r) for r in raw[:count]] if to_str else list(raw[:count]))
        else:                   return ([""] * count if to_str else [None] * count)

    def _lookup(mp, branches, path, i, branch_count):
        """Path match first, then flat fallback, then index fallback."""
        r = mp.get(path)
        if r is not None: return r
        r = mp.get("flat")
        if r is not None:
            if branch_count > 1 and len(r) == branch_count and i < len(r):
                return [r[i]]
            return r
        if i < len(branches): return branches[i][1]
        return []

    for i, (path, n_list) in enumerate(n_branches):
        v_list = v_map.get(path, v_branches[i][1] if i < len(v_branches) else [])
        if len(n_list) != len(v_list):
            # stats["errors"].append(
            #     "branch {} has {} labels but {} values, check the input lengths".format(
            #         path, len(n_list), len(v_list)
            #     )
            # )
            stats["errors"].append("Data mismatch")
        count  = min(len(n_list), len(v_list))
        if count == 0:
            continue

        branch_count = len(n_branches)
        p_list = _resolve(_lookup(p_map, _p_branches, path, i, branch_count), count, to_str=True)
        c_list = _resolve(_lookup(c_map, _c_branches, path, i, branch_count), count, to_str=False)
        g_list = _resolve(_lookup(g_map, _g_branches, path, i, branch_count), count, to_str=False)
        for n, v, p, c, gc in zip(n_list[:count], v_list[:count], p_list, c_list, g_list):
            try:
                row = {"name": str(n), "value": float(v)}
                if str(p).strip():
                    row["parent"] = str(p).strip()
                hex_c = _color_to_hex(c) if c is not None else None
                if hex_c:
                    row["color"] = hex_c
                hex_gc = _color_to_hex(gc) if gc is not None else None
                if hex_gc:
                    row["group_color"] = hex_gc
                rows.append(row)
            except (ValueError, TypeError):
                stats["skipped_rows"] += 1

    # if some rows are missing group colors, try to infer a stable parent -> color map
    # this supports the common gh case where group_colors is provided as a short palette
    # matching unique parent groups rather than every branch/item.
    parent_order = []
    for row in rows:
        p = row.get("parent")
        if p and p not in parent_order:
            parent_order.append(p)

    parent_color_map = {}
    for row in rows:
        p = row.get("parent")
        gc = row.get("group_color")
        if p and gc and p not in parent_color_map:
            parent_color_map[p] = gc

    if parent_order and len(parent_color_map) < len(parent_order):
        supplied_group_colors = []
        for _, branch_vals in _g_branches:
            for v in branch_vals:
                hex_gc = _color_to_hex(v)
                if hex_gc:
                    supplied_group_colors.append(hex_gc)

        # use ordered unique palette only when it looks like a per-group color input.
        if supplied_group_colors and len(supplied_group_colors) <= len(parent_order):
            palette = []
            for gc in supplied_group_colors:
                if gc not in palette:
                    palette.append(gc)
            for i, parent_name in enumerate(parent_order):
                if parent_name not in parent_color_map and i < len(palette):
                    parent_color_map[parent_name] = palette[i]

    if parent_color_map:
        for row in rows:
            p = row.get("parent")
            if p and not row.get("group_color") and p in parent_color_map:
                row["group_color"] = parent_color_map[p]

    return rows, stats


def teardown():
    idle = sc.sticky.get(_PFX + "IDLE")
    if idle:
        try: Rhino.RhinoApp.Idle -= idle
        except: pass

    ch = sc.sticky.get(_PFX + "CH")
    if ch:
        try: rd.DisplayPipeline.DrawForeground -= ch
        except: pass

    httpd = sc.sticky.get(_PFX + "HTTPD")
    if httpd:
        try: httpd.shutdown()
        except: pass
        try: httpd.server_close()
        except: pass

    bmp = sc.sticky.get(_PFX + "BMP")
    if bmp:
        try: bmp.Dispose()
        except: pass

    frm = sc.sticky.get(_PFX + "FORM")
    if frm:
        try: frm.Close()
        except: pass

    for key in [
        "STARTED", "FORM", "HTTPD", "IDLE", "CH", "BMP",
        "PNG_BYTES", "NEEDS_REDRAW", "ERR",
    ]:
        sc.sticky.pop(_PFX + key, None)


def write_json(path, payload):
    with open(path, "w", encoding="utf-8") as f:
        json.dump(payload, f, indent=2, ensure_ascii=False)


# ── Main ──────────────────────────────────────────────────────────────────────

try:
    # this part reads the current gh inputs and local dev settings
    g = globals()
    _trigger    = str(g.get("trigger") or "").strip().lower()
    _names      = g.get("labels")
    _values     = g.get("values")
    _parents    = g.get("groups")
    _colors     = g.get("item_colors")
    _group_colors = g.get("group_colors")
    _chart_type_raw = str(g.get("chart_type") or "").strip().lower()
    _chart_type = _chart_type_raw if _chart_type_raw else sc.sticky.get(_PFX + "CHART_TYPE", "treemap")
    sc.sticky[_PFX + "CHART_TYPE"] = _chart_type
    _title      = str(g.get("title")      or "Grasshopper Dashboard")
    _subtitle   = str(g.get("subtitle")   or "Live Data Feed")
    _units      = str(g.get("units")      or "m²")
    _font_scale = float(g.get("font_scale") or 1.0)
    _enable     = g.get("enable", True)
    _x          = int(g.get("position_x") or 20)
    _y          = int(g.get("position_y") or 60)
    _w          = int(g.get("chart_size") or 500)
    _viewport   = str(g.get("viewport") or "").strip()

    if _trigger == "reset":
        teardown()
        a = "reset complete"
        raise SystemExit

    # this part stores the overlay settings Rhino needs between runs
    sc.sticky[_PFX + "ENABLED"]  = bool(_enable)
    sc.sticky[_PFX + "X"]        = _x
    sc.sticky[_PFX + "Y"]        = _y
    sc.sticky[_PFX + "W"]        = _w
    sc.sticky[_PFX + "VIEWPORT"] = _viewport

    # grab a free port once per session
    if _PFX + "PORT" not in sc.sticky:
        import socket as _sock
        with _sock.socket() as _s:
            _s.bind(('', 0))
            sc.sticky[_PFX + "PORT"] = _s.getsockname()[1]
    PORT = sc.sticky[_PFX + "PORT"]
    URL  = "http://127.0.0.1:{}".format(PORT)

    INSTALL_DIR = _find_web_source()
    TEMP_DIR    = _get_temp_dir(PORT)
    OUTPUT_JSON = os.path.join(TEMP_DIR, "gh_dashboard.json")

    if _PFX + "LOCK" not in sc.sticky:
        sc.sticky[_PFX + "LOCK"] = threading.Lock()
    _lock = sc.sticky[_PFX + "LOCK"]

    # this part starts the local server and the preview window
    if _PFX + "STARTED" not in sc.sticky:

        class _H(SimpleHTTPRequestHandler):
            def __init__(self, *a, **kw):
                super().__init__(*a, directory=INSTALL_DIR, **kw)
            def translate_path(self, path):
                p = path.split('?')[0].split('#')[0]
                if p == '/gh_dashboard.json':
                    return os.path.join(TEMP_DIR, 'gh_dashboard.json')
                return super().translate_path(path)
            def do_POST(self):
                if self.path == "/screenshot":
                    n = int(self.headers.get("Content-Length", 0))
                    data = self.rfile.read(n)
                    with _lock:
                        sc.sticky[_PFX + "PNG_BYTES"]    = data
                        sc.sticky[_PFX + "NEEDS_REDRAW"] = True
                    self.send_response(200)
                    self.end_headers()
                else:
                    self.send_response(404)
                    self.end_headers()
            def end_headers(self):
                self.send_header("Cache-Control", "no-cache, no-store, must-revalidate")
                super().end_headers()
            def log_message(self, *a): pass

        _httpd = HTTPServer(("127.0.0.1", PORT), _H)
        threading.Thread(target=_httpd.serve_forever, daemon=True).start()

        import Eto.Forms as ef, Eto.Drawing as ed
        _wv           = ef.WebView()
        _form         = ef.Form()
        _form.Title   = "Data Muncher"
        _form.Size    = ed.Size(1100, 750)
        _form.Topmost = True
        _form.Content = _wv
        _icon_file = _find_icon_file()
        if _icon_file:
            try:
                _form.Icon = ed.Icon(_icon_file)
            except:
                pass

        def _on_loaded(sender, e):
            try: _wv.ExecuteScript("window.__GH_PORT={}".format(PORT))
            except: pass
        _wv.DocumentLoaded += _on_loaded
        _wv.Url = System.Uri(URL)

        def _on_closing(sender, e):
            e.Cancel = True
            _form.Visible = False
        _form.Closing += _on_closing

        _form.Show()
        sc.sticky[_PFX + "STARTED"] = True
        sc.sticky[_PFX + "FORM"]    = _form
        sc.sticky[_PFX + "HTTPD"]   = _httpd
        Rhino.RhinoApp.WriteLine("[DataMuncher] Ready on port {}".format(PORT))

    _frm = sc.sticky.get(_PFX + "FORM")
    if _frm is not None:
        _frm.Visible = bool(_enable)

    # this part turns browser screenshots into a Rhino display bitmap
    if _PFX + "IDLE" not in sc.sticky:
        def _idle(sender, e):
            needs = False
            data  = None
            with sc.sticky.get(_PFX + "LOCK", threading.Lock()):
                if sc.sticky.get(_PFX + "NEEDS_REDRAW"):
                    sc.sticky[_PFX + "NEEDS_REDRAW"] = False
                    needs = True
                    data  = sc.sticky.get(_PFX + "PNG_BYTES")
            if needs and data:
                try:
                    ms  = System.IO.MemoryStream(System.Array[System.Byte](data))
                    raw = sd.Bitmap(ms)
                    old = sc.sticky.get(_PFX + "BMP")
                    if old:
                        try: old.Dispose()
                        except: pass
                    sc.sticky[_PFX + "BMP"] = rd.DisplayBitmap(sd.Bitmap(raw))
                    raw.Dispose(); ms.Dispose()
                except Exception as ex:
                    sc.sticky[_PFX + "ERR"] = str(ex)
                Rhino.RhinoDoc.ActiveDoc.Views.Redraw()

        Rhino.RhinoApp.Idle += _idle
        sc.sticky[_PFX + "IDLE"] = _idle

    # this part draws the latest bitmap into the chosen Rhino viewport
    if _PFX + "CH" not in sc.sticky:
        def _draw(sender, e):
            if not sc.sticky.get(_PFX + "ENABLED", True): return
            vp = sc.sticky.get(_PFX + "VIEWPORT", "")
            if vp and e.Display.Viewport.Name != vp: return
            try:
                bmp = sc.sticky.get(_PFX + "BMP")
                if bmp:
                    e.Display.DrawBitmap(bmp,
                        sc.sticky.get(_PFX + "X", 20),
                        sc.sticky.get(_PFX + "Y", 60))
            except Exception as ex:
                sc.sticky[_PFX + "ERR"] = str(ex)

        rd.DisplayPipeline.DrawForeground += _draw
        sc.sticky[_PFX + "CH"] = _draw

    # this part packs the gh data into the json file the browser reads
    has_input = _names is not None and _values is not None
    rows, stats = build_rows(_names, _values, _parents, _colors, _group_colors) if has_input else ([], _empty_stats())

    if stats["errors"]:
        message = " | ".join(stats["errors"][:3])
        payload = _make_payload(_chart_type, _title, _subtitle, _units, _w, _font_scale, [], error=message)
        write_json(OUTPUT_JSON, payload)
        a = "input error | " + message
    elif rows:
        payload = _make_payload(_chart_type, _title, _subtitle, _units, _w, _font_scale, rows)
        write_json(OUTPUT_JSON, payload)

        notes = []
        if stats["skipped_rows"]:
            notes.append("skipped rows:{}".format(stats["skipped_rows"]))

        a = "OK | {} rows | {} | overlay:{}".format(
            len(rows), _chart_type.upper(), "ON" if _enable else "OFF")
        if notes:
            a += " | " + " | ".join(notes)
    else:
        if has_input and stats["skipped_rows"]:
            a = "no valid rows | skipped rows:{}".format(stats["skipped_rows"])
        else:
            a = "waiting for data..."

except Exception:
    a = "ERROR: " + traceback.format_exc()
    Rhino.RhinoApp.WriteLine("[DataMuncher] " + a)
# ---------- end data_muncher ----------
