# Grasshopper definition branching_towers_demo.gh (Grasshopper 1.0.8)
# plug-ins: DataMuncher.Components

# ---- group: INPUT POINTS
# DATA MUNCHER EXAMPLE
pt = Point([Point(-46.78348502, 22.17490581, 0), Point(-58.6760728, 14.4849932, 0), Point(-56.36753107, -10.57829645, 0), Point(-32.29057007, -9.802108525, 0), Point(-26.08741553, 6.718105283, 0), Point(-27.00682907, 18.18036527, 0)])

# ----
cluster = Cluster_2(offset=Slider(2.1, range=0..10), G=pt)

# ---- group: NO. FLOORS
number_slider = Slider(2.5, range=0..10)
flatten = FlattenTree(Tree=cluster, Path="{0}")
series = Series(Start=0, Step=number_slider, Count=Slider(4, range=0..100))
Z = UnitZ(Factor=series)
move = Move(Geometry=flatten, Motion=graft(Z))  # -> Geometry, Transform

# ----
merge = Merge(
    Data1=ColourSwatch(SwatchColor=RGBA(78, 120, 166, 100)),
    Data2=ColourSwatch(SwatchColor=RGBA(242, 143, 44, 100)),
    Data3=ColourSwatch(SwatchColor=RGBA(224, 88, 90, 100)))
crv = Curve(flatten(move.Geometry))
categories = Panel("""Commercial
Offices
Residential""")
crv_2 = Curve(crv)
lng = ListLength(List=crv_2)
area = Area(Geometry=crv_2)  # -> Area, Centroid
long = LongestList(ListA=graft(categories), ListB=move.Geometry, PaddingMode=2)  # -> flatten(ListA), ListB
charseq = CharSequence(Count=lng, CharPool="ABCDEFGHIJKLMNOPQRSTUVWXYZ", Format="{0}")
num = Number(area.Area)
long_2 = LongestList(ListA=graft(merge), ListB=move.Geometry, PaddingMode=2)  # -> ListA, ListB
concat = Concatenate(FragmentA="Zone-", FragmentB=charseq)

Z_2 = UnitZ(Factor=number_slider)
# DATA SORTING
boundary = BoundarySurfaces(Edges=long.ListB)
extr = Extrude(Base=boundary, Direction=Z_2)
preview = CustomPreview(Geometry=extr, Material=long_2.ListA)

list = ValueList({"treemap", "bar", "pie", "sankey", "sunburst"}, selected="treemap")
# DATA TREE TIPS
# ─────────────────────────────────
# Flat list  →  each item is its own segment
#               (no groups)
# 
# DataTree   →  each branch = one group
#               branch name is ignored;
#               use  groups  input for labels
# 
# Mix & match:
#   labels     {0;0}  {0;1}  {0;2}
#   values     {0;0}  {0;1}  {0;2}
#   groups     {0}    {0}    {0}   ← broadcast
#   g_colors   {0}    {0}    {0}   ← one per branch
data_muncher = DataMuncher(
    ChartType=list,
    Labels=concat,
    Values=num,
    Groups=long.ListA,
    ChartSize=Slider(690, range=0..1000),
    FontScale=Slider(1, range=0.5..3),
    Toggle=Toggle(True))

# ==== cluster Cluster_2
G = ClusterInput()
project = Project(Geometry=G, Plane=PlaneXY(0, 0, 0))  # -> Geometry, Transform

# ---- group: Network Points
hull = ConvexHull(Points=project.Geometry, Plane=PlaneXY(0, 0, 0))  # -> Hull, HullZ, Indices
voronoi = Voronoi(Points=project.Geometry, BruteForceOverride=False)

# ----
trim = TrimWithRegion(Curve=voronoi, Region=hull.Hull)  # -> Inside, Outside
crv = Curve(flatten(trim.Inside))

disc = Discontinuity(Curve=crv, Level=2)  # -> Points, Parameters
lng = ListLength(List=disc.Points)
expression = Expression(x=lng, Expression="x>2")
cull = CullPattern(List=crv, CullPattern=flatten(expression))

crv_2 = Curve(cull)
explode = Explode(Curve=crv_2, Recursive=True)  # -> flatten(Segments), Vertices
dupln = RemoveDuplicateLines(Lines=explode.Segments, Tolerance=0.01)
offset = ClusterInput()
cluster = Cluster(lines=dupln, offset=offset)
curves = ClusterOutput(cluster)

# ==== cluster Cluster
offset = ClusterInput()
lines = ClusterInput()
offset_2 = OffsetCurve(Curve=lines, Distance=expr("-x", offset), Corners=1)
offset_3 = OffsetCurve(Curve=lines, Distance=offset, Corners=1)
end = EndPoints(Curve=offset_3)  # -> Start, End
end_2 = EndPoints(Curve=offset_2)  # -> Start, End
ln = Line(StartPoint=end.Start, EndPoint=end_2.Start)
ln_2 = Line(StartPoint=end.End, EndPoint=end_2.End)
merge = Merge(Data1=offset_3, Data2=ln, Data3=ln_2, Data4=offset_2)
join = JoinCurves(Curves=merge, Preserve=False)
curves = ClusterOutput(join)
