# Grasshopper definition surface_panels_demo.gh (Grasshopper 1.0.8)
# plug-ins: DataMuncher.Components

# ---- group: INPUT CURVES
crv = Curve(graft(Tree({0;0;0}: [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], {0;0;1}: [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])))

# ----
data = Data(Tree({0}: [Point(-24.50272888, -35.52811986, 0.1270673933), Point(-24.50052308, -33.35321363, 0.1554462969), Point(-24.49126694, -31.1783074, 0.7071410641), Point(-24.46165292, -29.00340116, 0.2974138854), Point(-24.38442099, -26.82849493, 1.564769599), Point(-24.21313192, -24.6535887, 0.5887195328)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], {1}: [Point(-23.80651676, -36.1394407, 0.1270673933), Point(-23.8043127, -33.94060807, 0.1532635271), Point(-23.79506388, -31.73935072, 0.701010196), Point(-23.76547327, -29.53577743, 0.2862813355), Point(-23.68830237, -27.33000655, 1.547908489), Point(-23.51714868, -25.12216548, 0.5656491432)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], {2}: [Point(-23.11030526, -36.74979522, 0.1270673933), Point(-23.10810642, -34.527074, 0.1467703138), Point(-23.09887954, -32.29950719, 0.6827723436), Point(-23.0693591, -30.06731217, 0.2531646874), Point(-22.99237123, -27.83072543, 1.497750757), Point(-22.82162347, -25.59000157, 0.4970203045)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], {3}: [Point(-22.41409437, -37.35821862, 0.1270673933), Point(-22.41190424, -35.1116844, 0.1361305551), Point(-22.40271387, -32.85789137, 0.6528878566), Point(-22.37331028, -30.59716517, 0.198899853), Point(-22.29662713, -28.32986006, 1.415562458), Point(-22.12655519, -26.05635746, 0.3845653075)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], {4}: [Point(-21.71788409, -37.96374917, 0.1270673933), Point(-21.71570613, -35.69351516, 0.1216128139), Point(-21.70656681, -33.41362061, 0.6121110627), Point(-21.67732654, -31.12449889, 0.1248565552), Point(-21.60106933, -28.82662148, 1.303418143), Point(-21.43194205, -26.52049598, 0.2311226786)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], {5}: [Point(-21.02167443, -38.56542968, 0.1270673933), Point(-21.01951207, -36.27164659, 0.103583539), Point(-21.01043825, -33.96581647, 0.5614712268), Point(-20.98140752, -31.64847977, 0.03290375351), Point(-20.90569678, -29.32022443, 1.164148495), Point(-20.73778151, -26.98168346, 0.04056553123)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]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))

# ---- group: Form Making
cluster = Cluster(target=crv, points=data)

# ---- group: Edges Visibility
# DATA MUNCHER EXAMPLE
panel = Panel("""300
400""")
wires = BrepWireframe(Brep=cluster, Density=-1)
linetype = ModelLinetype(Name="Custom", Segments=panel)  # -> Linetype, Name, Segments, CapStyle, JoinStyle, Width, WidthUnits
# GH COLOR TWEEN
# ─────────────────────────────────
# Interpolates between input colours to produce a smooth gradient list.
# 
# INPUTS:
#   colors  - DataTree / List Color  — gradient stop colours per branch
#   count   - Item / List int        — number of output colours
#                                      single value  → applied to every branch
#                                      list / tree   → one per branch
curve_preview = CustomCurvePreview(Curve=wires, Linetype=linetype.Linetype, Colour=RGB(0, 0, 0))

# ----
debrep = DeconstructBrep(Brep=cluster)  # -> Faces, Edges, Vertices

mesh_uv = MeshSurface(Surface=debrep.Faces, UCount="1", VCount=Slider(62, range=0..100), Overhang=True, Equalize=False)
pa = PlanarityAnalysis(Mesh=mesh_uv, Max="0.01")  # -> M, P

# ---- group: Data Formatting
lng = ListLength(List=debrep.Faces)
series = Series(Start=0, Step=1, Count=lng)
expression = Expression(x=series, Expression="Format(\"{0:00}\", x)")
concat = Concatenate(FragmentA="Strip ", FragmentB=expression, FragmentC=" -")
list_length = ListLength(List=flatten(crv))

# ---- group: Data / Values
num = Number(pa.P)
abs = Absolute(Value=num)
ma = MassAddition(Input=abs)  # -> Result, PartialResults
shift_paths = ShiftPaths(Data=ma.Result, Offset=-1)
expression_2 = Expression(x=shift_paths, Expression="Round((x*100),1)")

# ---- group: Generate groups labels
char_sequence = CharSequence(Count=list_length, CharPool="ABCDEFGHIJKLMNOPQRSTUVWXYZ", Format="{0}")
concat_2 = Concatenate(FragmentA="Surface ", FragmentB=char_sequence)
graft_tree = GraftTree(Tree=concat_2, IncludeEmptyLists=True, IncludeNullItems=True)

# ----
panel_2 = Panel(expression_2)

# ---- group: Custom Component to generate color gradient
tween_colors = TweenColors(
    InputColors=[ColourSwatch(SwatchColor=RGB(237, 130, 173)), ColourSwatch(SwatchColor=RGB(209, 172, 250))],
    ColorsCount=list_length)  # -> graft(GradientColors)

# COLOR MAP
# ─────────────────────────────────
# Maps a list of values to gradient colours using a defined domain.
# 
# INPUTS:
#   colors  - DataTree / List Color  — gradient stop colours per branch
#   values  - DataTree / List float  — values to map to colours
#   domain  - Item / List float      — [min, max] domain bounds
#                                      two numbers: explicit min/max
#                                      omit / None: auto-computed from values
construct_domain = ConstructDomain(DomainStart=0, DomainEnd="100")
map_colors = MapColors(
    Colors=[ColourSwatch(SwatchColor=RGB(173, 217, 240)), ColourSwatch(SwatchColor=RGB(170, 133, 212))],
    Values=expression_2,
    Domain=construct_domain)

# ----
preview = CustomPreview(Geometry=debrep.Faces, Material=map_colors)
list = ValueList({"treemap", "pack", "bar", "sunburst", "sankey"}, selected="sunburst")
# DATA TREE TIPS
# ─────────────────────────────────
# Flat list  →  each item is its own segment
#               (no groups)
# 
# DataTree   →  each branch = one group
#               branch name is ignored;
#               use  groups  input for labels
# 
# Mix & match:
#   labels     {0;0}  {0;1}  {0;2}
#   values     {0;0}  {0;1}  {0;2}
#   groups     {0}    {0}    {0}   ← broadcast
#   g_colors   {0}    {0}    {0}   ← one per branch
data_muncher = DataMuncher(
    ChartType=list,
    Labels=concat,
    Values=expression_2,
    Groups=graft_tree,
    ItemColors=map_colors,
    GroupColors=tween_colors,
    ChartTitle="DASHBOARD",
    ChartSubtitle="Panels Deviation",
    Units="%",
    ChartSize=Slider(400, range=0..1000),
    FontScale=Slider(1.448, range=0..2),
    Viewport="Perspective",
    Toggle=Toggle(True))

# ==== cluster Cluster
points = ClusterInput()
flip = FlipMatrix(Data=points)
nurbs = NurbsCurve(Vertices=flip, Degree=3, Periodic=False)  # -> flatten(Curve), Length, Domain
fit_line = FitLine(Points=flatten(points))
target = ClusterInput()
flow = Flow(Geometry=nurbs.Curve, Base=fit_line, Target=target, ReverseBase=False, ReverseTarget=False, Stretch=True, Rigid=False)
loft = Loft(Curves=flow, Options={Adjust=False, Closed=False, LoftEnds=0, LoftSimp=0, LoftType=3, Rebuild=10, Refit=0.01})
surface = ClusterOutput(loft)
