# Grasshopper definition branching_towers_demo.gh (Grasshopper 1.0.8)
# plug-ins: DataMuncher.Components

# ---- group: INPUT POINTS
# DATA MUNCHER EXAMPLE
pt = Point([<point referenced from the Rhino model> x6])

# ----
cluster = Cluster_2(offset=Slider(2.1, range=0..10), G=pt)

# ---- group: NO. FLOORS
number_slider = Slider(2.5, range=0..10)
flatten = FlattenTree(Tree=cluster, Path="{0}")
series = Series(Start=0, Step=number_slider, Count=Slider(4, range=0..100))
Z = UnitZ(Factor=series)
move = Move(Geometry=flatten, Motion=graft(Z))  # -> Geometry, Transform

# ----
crv = Curve(flatten(move.Geometry))
categories = Panel("""Commercial
Offices
Residential""")
crv_2 = Curve(crv)
merge = Merge(
    Data1=ColourSwatch(SwatchColor=RGBA(78, 120, 166, 100)),
    Data2=ColourSwatch(SwatchColor=RGBA(242, 143, 44, 100)),
    Data3=ColourSwatch(SwatchColor=RGBA(224, 88, 90, 100)))
lng = ListLength(List=crv_2)
area = Area(Geometry=crv_2)  # -> Area, Centroid
long = LongestList(ListA=graft(categories), ListB=move.Geometry, PaddingMode=2)  # -> flatten(ListA), ListB
charseq = CharSequence(Count=lng, CharPool="ABCDEFGHIJKLMNOPQRSTUVWXYZ", Format="{0}")
num = Number(area.Area)
long_2 = LongestList(ListA=graft(merge), ListB=move.Geometry, PaddingMode=2)  # -> ListA, ListB
concat = Concatenate(FragmentA="Zone-", FragmentB=charseq)

# ----
# DATA SORTING
boundary = BoundarySurfaces(Edges=long.ListB)
Z_2 = UnitZ(Factor=number_slider)
extr = Extrude(Base=boundary, Direction=Z_2)
preview = CustomPreview(Geometry=extr, Material=long_2.ListA)

list = ValueList({"treemap", "bar", "pie", "sankey", "sunburst"}, selected="treemap")
data_muncher = DataMuncher(
    Chart_type=list,
    Parents=long.ListA,
    Names=concat,
    Values=num,
    Chart_size=Slider(690, range=0..1000),
    Font_scale=Slider(1, range=0.5..3),
    Enable=Toggle(False))

# ==== cluster Cluster_2
G = ClusterInput()
offset = ClusterInput()
project = Project(Geometry=G, Plane=PlaneXY(0, 0, 0))  # -> Geometry, Transform

# ---- group: Network Points
hull = ConvexHull(Points=project.Geometry, Plane=PlaneXY(0, 0, 0))  # -> Hull, HullZ, Indices
voronoi = Voronoi(Points=project.Geometry, BruteForceOverride=False)

# ----
trim = TrimWithRegion(Curve=voronoi, Region=hull.Hull)  # -> Inside, Outside
crv = Curve(flatten(trim.Inside))

disc = Discontinuity(Curve=crv, Level=2)  # -> Points, Parameters
lng = ListLength(List=disc.Points)
expression = Expression(x=lng, Expression="x>2")
cull = CullPattern(List=crv, CullPattern=flatten(expression))

crv_2 = Curve(cull)
explode = Explode(Curve=crv_2, Recursive=True)  # -> flatten(Segments), Vertices
dupln = RemoveDuplicateLines(Lines=explode.Segments, Tolerance=0.01)
cluster = Cluster(lines=dupln, offset=offset)
curves = ClusterOutput(cluster)

# ==== cluster Cluster
offset = ClusterInput()
lines = ClusterInput()
offset_2 = OffsetCurve(Curve=lines, Distance=expr("-x", offset), Corners=1)
offset_3 = OffsetCurve(Curve=lines, Distance=offset, Corners=1)
end = EndPoints(Curve=offset_3)  # -> Start, End
end_2 = EndPoints(Curve=offset_2)  # -> Start, End
ln = Line(StartPoint=end.Start, EndPoint=end_2.Start)
ln_2 = Line(StartPoint=end.End, EndPoint=end_2.End)
merge = Merge(Data1=offset_3, Data2=ln, Data3=ln_2, Data4=offset_2)
join = JoinCurves(Curves=merge, Preserve=False)
curves = ClusterOutput(join)
