# Grasshopper definition mesh_relaxation_demo.gh (Grasshopper 1.0.8)
# plug-ins: Pufferfish, Weaverbird, eleFront5

# ---- group: initial mesh dimensions and height
number_slider = Slider(50, range=0..100)
number_slider_2 = Slider(30, range=0..100)
pt = ConstructPoint(XCoordinate=0, YCoordinate=0, ZCoordinate=Slider(10, range=0..100))
rectangle = Rectangle(Plane=pt, XSize=number_slider, YSize=number_slider_2, Radius=0)  # -> Rectangle, Length
mplane = MeshPlane(Boundary=rectangle.Rectangle, WidthCount=expr("x/2", number_slider), HeightCount=expr("x/2", number_slider_2))  # -> Mesh, Area

# ---- group: Columns Points
pt_2 = Point([Point(34.31230208, 13.24363966, 0), Point(11.09193388, 5.302304553, 0), Point(53.73677857, 13.24363966, 0), Point(39.07624795, 29.355106, 0), Point(11.46798087, 34.25601557, 0)])

# ---- group: column dimensions
number_slider_3 = Slider(6, range=0..10)

# ----
demesh = DeconstructMesh(Mesh=mplane.Mesh)  # -> Vertices, Faces, Colours, Normals

# ---- group: column profile
mid_curve_z = Slider(0.5, range=0..1)
mid_curve_scale = Slider(0.807, range=0..1)

# ----
dom = ConstructDomain(DomainStart=expr("-x/2", number_slider_3), DomainEnd=expr("x/2", number_slider_3))
model_linetype = ModelLinetype(Name="W-1", Width=Slider(0.3, range=0..10))
material = CreateMaterial(
    Diffuse=ColourSwatch(SwatchColor=RGB(136, 40, 184)),
    Specular=RGB(255, 255, 255),
    Emission=RGB(0, 0, 0),
    Transparency=Slider(0.307, range=0..1),
    Shine=0)
Z = UnitZ(Factor=1)
pt_3 = Point(pt_2)
cullpt = CullDuplicates(Points=pt_3, Tolerance="3", CullMode=3)  # -> Points, Indices, Valence
Z_2 = UnitZ(Factor=1)
points = EleFrontDataDescription(cullpt.Points, ShiftDepth=0, isNameSet=False)
line = LineSDL(Start=points, Direction=Z_2, Length=Slider(20, range=0..100))
end = EndPoints(Curve=line)  # -> Start, End
annotation_text_settings = AnnotationTextSettings(TextHeight=Slider(1.2, range=0..10))  # -> TextSettings, Font, TextHeight, TextGap, Mask, MaskColour, MaskMargins, MaskFrame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
yz = YZPlane(Origin=end.End)
points_2 = EleFrontDataDescription(points, ShiftDepth=0, isNameSet=False)
listdexs = ListIndices(List=points_2)
indices = EleFrontDataDescription(listdexs, ShiftDepth=0, isNameSet=False)
concat = Concatenate(FragmentA="Column_", FragmentB=indices)
leader = Leader(
    Plane=yz,
    Curve=line,
    Text=concat,
    Style=<geometry referenced from the Rhino model>,
    TextSettings=annotation_text_settings.TextSettings)  # -> Leader, Plane, Curve, Text, Style
parent = EleFrontDataDescription(concat, ShiftDepth=0, isNameSet=True)
list = ValueList({"treemap", "bar", "pack", "pie", "sankey", "sunburst"}, selected="treemap")

# ---- group: columns holes
cp = ClosestPoint(Point=pt_2, Cloud=demesh.Vertices)  # -> ClosestPoint, CPIndex, Distance
facen = FaceNormals(Mesh=mplane.Mesh)  # -> Centers, Normals

# ----
cir = Circle(Plane=cp.ClosestPoint, Radius=number_slider_3)
rectangle_2 = Rectangle(Plane=cp.ClosestPoint, XSize=dom, YSize=dom, Radius=0)  # -> Rectangle, Length

# ---- group: columns holes (continued)
incurves = PointInCurves(Point=facen.Centers, Curves=rectangle_2.Rectangle)  # -> Relationship, Index, Point
cullf = CullFaces(Mesh=mplane.Mesh, Pattern=invert(incurves.Relationship))

# ---- group: columns mesh
wbnaked = WeaverbirdsNakedBoundary(MeshClosedPolylines=cullf)
project = Project(Geometry=wbnaked, Plane=PlaneXY(0, 0, 0))  # -> Geometry, Transform
tweencrv = TweenCurve(CurveA=wbnaked, CurveB=project.Geometry, Factor=mid_curve_z, BlendType=0)
pcen = PolygonCenter(Polyline=tweencrv)  # -> CenterV, CenterE, CenterA
scale = Scale(Geometry=tweencrv, Center=pcen.CenterV, Factor=mid_curve_scale)  # -> Geometry, Transform
cluster = Cluster(C=wbnaked, C_2=scale.Geometry)
cluster_2 = Cluster(C=scale.Geometry, C_2=project.Geometry)
mesh = Mesh(cluster)
mesh_2 = Mesh(cluster_2)

# ----
curve_preview = CustomCurvePreview(Curve=rectangle_2.Rectangle, Linetype=model_linetype, Colour=RGB(0, 0, 0))

# ---- group: columns mesh / subdivide mesh
strips = RefineStrips(Mesh=mesh, Level=1)
strips_2 = RefineStrips(Mesh=mesh_2, Level=Slider(2, range=0..10))

# ---- group: cleaning the mesh / extracting information
cullf_2 = CullFaces(Mesh=mplane.Mesh, Pattern=incurves.Relationship)
mjoin = MeshJoin(Meshes=cullf_2)
mjoin_2 = MeshJoin(Meshes=flatten([mjoin, strips, strips_2]))
wbjoin = WeaverbirdsJoinMeshesAndWeld(Mesh=mjoin_2, Weld=invert(False))
nv = NakedVertices(Mesh=wbjoin)  # -> ClothedIndex, NakedIndex, ClothedPts, NakedPts

# ----
bottom_curves = Curve(project.Geometry)
naked_points = Point(nv.NakedPts)
mesh_3 = Mesh(wbjoin)
expression = Expression(x=naked_points, Expression="x.Z = 0")
pcen_2 = PolygonCenter(Polyline=bottom_curves)  # -> CenterV, CenterE, CenterA
dispatch = Dispatch(List=naked_points, DispatchPattern=expression)  # -> ListA, ListB

# ---- group: columns base anchor points to targets
cir_2 = Circle(Plane=pcen_2.CenterV, Radius=Slider(6, range=0..10))
pull = PullPoint(Point=dispatch.ListA, Geometry=cir_2, ClosestOnly=True)  # -> ClosestPoint, Distance, Index
anchor = Anchor(Point=dispatch.ListA, Target=pull.ClosestPoint, Strength=10000)

# ----
edgelengths = EdgeLengths(Mesh=mesh_3, LengthFactor=Slider(0.569, range=0..1), Strength=1)
anchor_2 = Anchor(Point=dispatch.ListB, Strength=10000)
show = Show(G=mesh_3)
entwine = Entwine(Branch00=show, Branch01=[edgelengths, anchor_2, anchor], FlattenInputs=True)
zombiesolver = ZombieSolver(GoalObjects=entwine, Threshold=1e-10, Tolerance=0.0001, MaxIterations=100)  # -> I, V, O
item = ListItem(List=zombiesolver.O, Index=0, Wrap=True)
unweld = UnweldMesh(Mesh=item, Angle=degrees(1.570796327))
stripper = Stripper(Mesh=item)

# ---- group: GEOMETRY PREVIEW
preview = CustomPreview(Geometry=unweld, Material=material)

# ----
clean = CombineClean(Meshes=graft(stripper))
facen_2 = FaceNormals(Mesh=clean)  # -> Centers, Normals
dprod = DotProduct(VectorA=facen_2.Normals, VectorB=Z, Unitize=False)
avr = Average(Input=dprod)
larger = LargerThan(FirstNumber=avr, SecondNumber=Slider(0.307, range=0..1))  # -> LargerThan, OrEqualTo
cull = CullPattern(List=clean, CullPattern=invert(larger.LargerThan))  # -> flatten(List)
lng = ListLength(List=cull)
wheel = ColourWheel(
    lng,
    ColourGrips_Style=21,
    ColourGrips_Grip=[2.642087441, 5.783680095, 4.212883768, 1.071291114],
    ColourGrips_Lum=[0.1225670854, 0.3565369159],
    ColourGrips_Range=[0.876939914, 0.876939914, 0.876939914, 0.876939914],
    ColourGrips_Sat=[0.1149530534, 0.39078495])
cull_2 = CullPattern(List=clean, CullPattern=larger.LargerThan)
area = Area(Geometry=cull)  # -> Area, Centroid
preview_2 = CustomPreview(Geometry=cull_2, Material=ColourSwatch(SwatchColor=RGBA(145, 145, 145, 152)))
pull_2 = PullPoint(Point=area.Centroid, Geometry=points, ClosestOnly=True)  # -> ClosestPoint, Distance, Index
material_2 = CreateMaterial(
    Diffuse=wheel,
    Specular=RGB(255, 255, 255),
    Emission=RGB(0, 0, 0),
    Transparency=Slider(0.29, range=0..1),
    Shine=Slider(0.873, range=0..1))
cset = CreateSet(List=pull_2.Index)  # -> Set, Map
mindex = MemberIndex(Set=pull_2.Index, Member=cset.Set)  # -> Index, Count
item_2 = ListItem(List=cull, Index=mindex.Index, Wrap=True)
geometry = EleFrontDataDescription(item_2, ShiftDepth=0, isNameSet=True)
area_2 = Area(Geometry=geometry)  # -> Area, Centroid
data = EleFrontDataDescription(area_2.Area, ShiftDepth=0, isNameSet=True)
material_3 = EleFrontDataDescription(material_2, ShiftDepth=0, isNameSet=False)
long = LongestList(ListA=data, ListB=graft(parent), PaddingMode=2)  # -> ListA, ListB
preview_3 = CustomPreview(Geometry=flatten(cull), Material=flatten(material_3))
data_2 = EleFrontDataDescription(data, ShiftDepth=0, isNameSet=True)
parent_2 = EleFrontDataDescription(long.ListB, ShiftDepth=0, isNameSet=True)
listdexs_2 = ListIndices(List=data_2)
concat_2 = Concatenate(FragmentA=graft("C_"), FragmentB=graft(indices), FragmentC="_", FragmentD=listdexs_2)
parent_3 = EleFrontDataDescription(flatten(parent_2), ShiftDepth=0, isNameSet=True)
data_3 = EleFrontDataDescription(flatten(data), ShiftDepth=0, isNameSet=True)
names = EleFrontDataDescription(flatten(concat_2), ShiftDepth=0, isNameSet=True)
viewport = Python3Script(
    chart_type=list,
    parents=parent_3,
    names=names,
    values=data_3,
    trigger=Button(),
    w=Slider(470, range=0..1000),
    enable=Toggle(True))  # -> out, a; inputs parents: list, names: list, values: list
# ---------- viewport: Python ----------
"""
GH Dashboard — Viewport (Final)
INPUTS:
  names      - List str
  values     - List float
  parents    - List str (optional)
  chart_type - Item str ("treemap", "bar", "pack", "radial", "sankey")
  title      - Item str
  subtitle   - Item str
  trigger    - Item any
  enable     - Item bool
  x, y       - Item int
  w          - Item int
"""

import json, os, datetime, threading, traceback
import scriptcontext as sc
import Rhino
import Rhino.Display as rd
import System.Drawing as sd
import System.IO
import System
from http.server import HTTPServer, SimpleHTTPRequestHandler

SERVE_DIR   = r"C:\Users\Dell\Documents\GitHub\data_muncher"
OUTPUT_JSON = os.path.join(SERVE_DIR, "gh_dashboard.json")

# pick a free port once per session, reuse it across GH solves
if "GH_VP_PORT" not in sc.sticky:
    import socket as _sock
    with _sock.socket() as _s:
        _s.bind(('', 0))
        sc.sticky["GH_VP_PORT"] = _s.getsockname()[1]
PORT = sc.sticky["GH_VP_PORT"]
URL  = "http://127.0.0.1:{}".format(PORT)

out = "starting..."

try:
    _names      = globals().get("names")   or[]
    _values     = globals().get("values")  or []
    _parents    = globals().get("parents") or[]
    _chart_type = str(globals().get("chart_type") or "treemap").lower()
    _title      = str(globals().get("title") or "Grasshopper Dashboard")
    _subtitle   = str(globals().get("subtitle") or "Live Data Feed")
    _font_scale = float(globals().get("font_scale") or 1.0)
    _enable     = globals().get("enable",  True)
    _x          = int(globals().get("x") or 20)
    _y          = int(globals().get("y") or 60)
    _w          = int(globals().get("w") or 500)

    sc.sticky["GH_VP_ENABLED"] = bool(_enable)
    sc.sticky["GH_VP_X"]       = _x
    sc.sticky["GH_VP_Y"]       = _y
    sc.sticky["GH_VP_W"]       = _w

    # firing up the server
    if "GH_VP_STARTED" not in sc.sticky:
        class _H(SimpleHTTPRequestHandler):
            def __init__(self, *a, **kw):
                super().__init__(*a, directory=SERVE_DIR, **kw)
            def do_POST(self):
                if self.path == "/screenshot":
                    n = int(self.headers.get("Content-Length", 0))
                    sc.sticky["GH_VP_PNG_BYTES"] = self.rfile.read(n)
                    self.send_response(200)
                    self.end_headers()
                    sc.sticky["GH_VP_NEEDS_REDRAW"] = True
                else:
                    self.send_response(404)
                    self.end_headers()
            def end_headers(self):
                self.send_header("Cache-Control", "no-cache, no-store, must-revalidate")
                super().end_headers()
            def log_message(self, *a): pass

        threading.Thread(target=lambda: HTTPServer(("127.0.0.1", PORT), _H).serve_forever(), daemon=True).start()

        import Eto.Forms as ef, Eto.Drawing as ed
        _wv           = ef.WebView()
        _form         = ef.Form()
        _form.Title   = "GH Dashboard"
        _form.Size    = ed.Size(1100, 750)
        _form.Content = _wv

        # inject the port after every page load so JS knows where to POST
        def _on_loaded(sender, e):
            try: _wv.ExecuteScript("window.__GH_PORT={}".format(PORT))
            except: pass
        _wv.DocumentLoaded += _on_loaded

        _wv.Url = System.Uri(URL)
        _form.Show()

        sc.sticky["GH_VP_STARTED"] = True
        sc.sticky["GH_VP_FORM"]    = _form

    # safe guard bitmap updates
    if "GH_VP_IDLE" not in sc.sticky:
        def _idle(sender, e):
            if sc.sticky.get("GH_VP_NEEDS_REDRAW"):
                sc.sticky["GH_VP_NEEDS_REDRAW"] = False
                data = sc.sticky.get("GH_VP_PNG_BYTES")
                if data:
                    try:
                        ms  = System.IO.MemoryStream(System.Array[System.Byte](data))
                        raw = sd.Bitmap(ms)
                        
                        old_bmp = sc.sticky.get("GH_VP_BMP")
                        if old_bmp:
                            try: old_bmp.Dispose()
                            except: pass
                            
                        new_bmp = sd.Bitmap(raw)
                        sc.sticky["GH_VP_BMP"] = rd.DisplayBitmap(new_bmp)
                        raw.Dispose()
                        ms.Dispose()
                    except Exception as ex:
                        sc.sticky["GH_VP_ERR"] = str(ex)
                Rhino.RhinoDoc.ActiveDoc.Views.Redraw()

        Rhino.RhinoApp.Idle += _idle
        sc.sticky["GH_VP_IDLE"] = _idle

    # handler — register once only; reads position/enabled from sticky dynamically
    if "GH_VP_CH" not in sc.sticky:
        def _draw(sender, e):
            if not sc.sticky.get("GH_VP_ENABLED", True): return
            try:
                bmp = sc.sticky.get("GH_VP_BMP")
                if bmp: e.Display.DrawBitmap(bmp, sc.sticky.get("GH_VP_X", 20), sc.sticky.get("GH_VP_Y", 60))
            except Exception as ex:
                sc.sticky["GH_VP_ERR"] = str(ex)

        rd.DisplayPipeline.DrawForeground += _draw
        sc.sticky["GH_VP_CH"] = _draw

    #json making
    if _names and _values and len(_names) == len(_values):
        _parents = (_parents + [""] * len(_names))[:len(_names)]
        rows =[{"name": str(n), "value": float(v), **({"parent": str(p)} if p else {})}
                for n, v, p in zip(_names, _values, _parents) if n is not None and v is not None]
        
        payload = {
            "updated": datetime.datetime.now().strftime("%Y-%m-%d %H:%M:%S"),
            "config": {
                "type": _chart_type,
                "title": _title,
                "subtitle": _subtitle,
                "w": _w,
                "font_scale": _font_scale
            },
            "data": rows
        }
        
        with open(OUTPUT_JSON, "w") as f:
            json.dump(payload, f, indent=2)
            
        out = "OK | {} rows | {} | overlay:{}".format(len(rows), _chart_type.upper(), "ON" if _enable else "OFF")
    else:
        out = "waiting for data"

except Exception:
    out = "ERROR: " + traceback.format_exc()
# ---------- end viewport ----------
panel = Panel(viewport.out)

# ==== cluster Cluster
C = ClusterInput()
C_2 = ClusterInput()
explode = Explode(Curve=C, Recursive=True)  # -> Segments, Vertices
explode_2 = Explode(Curve=C_2, Recursive=True)  # -> Segments, Vertices
end = EndPoints(Curve=explode_2.Segments)  # -> Start, End
end_2 = EndPoints(Curve=explode.Segments)  # -> Start, End
merge = Merge(Data1=graft(end_2.Start), Data2=graft(end_2.End), Data3=graft(end.End), Data4=graft(end.Start))
conmesh = ConstructMesh(Vertices=merge, Faces={A=0, B=1, C=2, D=3})
trim = TrimTree(Tree=conmesh, Depth=1)
mjoin = MeshJoin(Meshes=trim)
M = ClusterOutput(mjoin)
