# Grasshopper definition plugin_demo.gh (Grasshopper 1.0.8)
# plug-ins: Data Muncher.Components

crv = Curve([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])
panel = Panel("""Residential
Commercial
Industrial""")
crv_2 = Curve(crv)
lng = ListLength(List=crv_2)
area = Area(Geometry=crv_2)  # -> Area, Centroid
charseq = CharSequence(Count=lng, CharPool="ABCDEFGHIJKLMNOPQRSTUVWXYZ", Format="{0}")
num = Number(area.Area)
concat = Concatenate(FragmentA="Zone-", FragmentB=charseq)
partition = PartitionList(List=concat, Size=Slider(6, range=0..10))
long = LongestList(ListA=panel, ListB=partition, PaddingMode=3)  # -> flatten(ListA), ListB
list = ValueList({"treemap", "bar", "pie", "sankey", "sunburst"}, selected="bar")
data_muncher = DataMuncher(
    Chart_type=list,
    Parents=long.ListA,
    Names=concat,
    Values=num,
    Units="sqm",
    Chart_size=Slider(623, range=0..1000),
    Font_scale=Slider(1.5, range=0.5..3),
    Enable=Toggle(True))
