# Grasshopper definition simple_data_demo.gh (Grasshopper 1.0.8)
# plug-ins: DataMuncher.Components

# DATA MUNCHER EXAMPLE
list = ValueList({"treemap", "bar", "pie", "sankey", "sunburst"}, selected="treemap")
data = Data(["Commercial", "Commercial", "Commercial", "Commercial", "Commercial", "Commercial", "Commercial", "Offices", "Offices", "Offices", "Offices", "Offices", "Offices", "Offices", "Residential", "Residential", "Residential", "Residential", "Residential", "Residential", "Residential", "Residential", "Residential", "Residential", "Residential", "Residential", "Residential", "Residential"])
data_2 = Data(["Zone-A", "Zone-B", "Zone-C", "Zone-D", "Zone-E", "Zone-F", "Zone-G", "Zone-H", "Zone-I", "Zone-J", "Zone-K", "Zone-L", "Zone-M", "Zone-N", "Zone-O", "Zone-P", "Zone-Q", "Zone-R", "Zone-S", "Zone-T", "Zone-U", "Zone-V", "Zone-W", "Zone-X", "Zone-Y", "Zone-Z", "Zone-AA", "Zone-AB"])
data_3 = Data([35.7613624, 23.24176626, 28.48401937, 30.22404749, 44.50056539, 32.20981636, 64.41763343, 35.7613624, 23.24176626, 28.48401937, 30.22404749, 44.50056539, 32.20981636, 64.41763343, 35.7613624, 23.24176626, 28.48401937, 30.22404749, 44.50056539, 32.20981636, 64.41763343, 35.7613624, 23.24176626, 28.48401937, 30.22404749, 44.50056539, 32.20981636, 64.41763343])
data_muncher = DataMuncher(
    Chart_type=list,
    Parents=data,
    Names=data_2,
    Values=data_3,
    Chart_size=Slider(690, range=0..1000),
    Font_scale=Slider(1, range=0.5..3),
    Enable=Toggle(False))
