# Grasshopper definition simple_data_demo_v3 [Apr-01 '26, 1740].gh (Grasshopper 1.0.8)
# plug-ins: DataMuncher.Components

panel = Panel("""INDUSTRIAL
OFFICE
RESIDENTIAL""")
number_slider = Slider(44, range=0..100)
swatch = ColourSwatch(SwatchColor=RGB(255, 173, 161))
swatch_2 = ColourSwatch(SwatchColor=RGB(133, 147, 237))
swatch_3 = ColourSwatch(SwatchColor=RGB(219, 157, 250))
series = Series(Start=0, Step=1, Count=number_slider)
list_length = ListLength(List=panel)
charseq = CharSequence(Count=number_slider, CharPool="ABCDEFGHIJKLMNOPQRSTUVWXYZ", Format="{0}")
merge = Merge(Data1=swatch_3, Data2=swatch, Data3=swatch_2)
entwine = Entwine(
    Branch00=[swatch_3, ColourSwatch(SwatchColor=RGB(255, 201, 218))],
    Branch01=[swatch, ColourSwatch(SwatchColor=RGB(160, 216, 242))],
    Branch02=[swatch_2, ColourSwatch(SwatchColor=RGB(180, 240, 200))],
    FlattenInputs=True)
graft = GraftTree(Tree=merge, IncludeEmptyLists=True, IncludeNullItems=True)
parition_data = ParitionData(Data=charseq, Count=list_length)
parition_data_2 = ParitionData(Data=series, Count=list_length)
graft_tree = GraftTree(Tree=panel, IncludeEmptyLists=True, IncludeNullItems=True)
tree_statistics = TreeStatistics(Tree=parition_data_2)  # -> Paths, Length, Count
tween_colors = TweenColors(InputColors=entwine, ColorsCount=graft(tree_statistics.Length))
list = ValueList({"treemap", "pack", "bar", "sunburst", "sankey"}, selected="sankey")
data_muncher = DataMuncher(
    ChartType=list,
    Labels=parition_data,
    Values=parition_data_2,
    Groups=graft_tree,
    ItemColors=tween_colors,
    GroupColors=graft,
    ChartTitle="DASHBOARD",
    ChartSubtitle="Data Visualization",
    Units="m²",
    ChartSize=Slider(539, range=0..1000),
    FontScale=Slider(1.448, range=0..2),
    Viewport="Perspective",
    Toggle=Toggle(True))
