# Grasshopper definition surface_panels_demo.gh (Grasshopper 1.0.8)
# plug-ins: DataMuncher.Components, eleFront5

reference_by_layer = ReferenceByLayer(LayerName="Crvs", lightweight=False, DisableAutoUpdate=False)
crv = Curve(graft(reference_by_layer))

# ---- group: Form Making
fiocchi_rigati = Python3Script(
    length=Slider(55, range=5..100),
    width=Slider(100, range=5..100),
    height=Slider(13, range=5..50),
    waveAmp=Slider(0.83, range=0..1),
    twist=Slider(1.55, range=0..5),
    edgeCurve=Slider(1, range=0..1))  # -> pasta, surface, points
# ---------- fiocchi_rigati: Python ----------
"""
Institute of Advanced Architecture Catalonia (IAAC)
MaCAD Complex Forming, taught by Hesham Shawqy and James McBennett
Formulas from the book `Pasta by Design` (2011) by George L. Legendre
"""

import math
import Rhino.Geometry as rg
import Grasshopper as gh
from Grasshopper.Kernel.Data import GH_Path

pasta = "Fiocchi Rigati"

# resolution inputs
if 'u' not in dir() or u is None: u = 80
if 'v' not in dir() or v is None: v = 33

u_min = 1
u_max = 200
u_count = max(u_min, min(u_max, int(u)))

v_min = 1
v_max = 200
v_count = max(v_min, min(v_max, int(v)))

# size inputs
if 'length' not in dir() or length is None: length = 1.0
if 'width' not in dir() or width is None: width = 1.0
if 'height' not in dir() or height is None: height = 1.0

# geometry control inputs
if 'waveAmp' not in dir() or waveAmp is None: waveAmp = 1.0
if 'twist' not in dir() or twist is None: twist = 1.0
if 'edgeCurve' not in dir() or edgeCurve is None: edgeCurve = 1.0

# create datatree and temp storage
points = gh.DataTree[rg.Point3d]()
temp_points = []

# reference values for normalization
u_ref = 81
v_ref = 81

u_out = u_count
v_out = v_count

# parametric equations
for ui in range(u_count):
    for vi in range(v_count):
        
        # normalize to reference range
        u_norm = (ui / float(u_count)) * u_ref
        v_norm = (vi / float(v_count)) * v_ref
        
        alpha = 10 * waveAmp * math.cos((u_norm + 80) / 80 * math.pi) * math.sin((v_norm + 110) / 100 * math.pi)**9
        beta = (35 * v_norm) / 80 + 4 * twist * math.sin(u_norm / 80 * math.pi) * math.sin((v_norm - 10) / 120 * math.pi)
        
        if 20 * (u_count/u_ref) <= ui <= 60 * (u_count/u_ref):
            x = (30 * u_norm) / 80 + 7 * edgeCurve * math.sin((u_norm + 40) / 40 * math.pi)**3 * math.sin((v_norm + 110) / 100 * math.pi)**9
        else:
            x = (30 * u_norm) / 80 + alpha
        
        y = beta - 4 * twist * math.sin(u_norm / 80 * math.pi) * math.sin((70 - v_norm) / 120 * math.pi)
        
        z = 3 * waveAmp * math.sin((u_norm + 10) / 20 * math.pi) * math.sin(v_norm / 80 * math.pi)**1.5 - \
            0.7 * ((math.sin(3 * v_norm / 8 * math.pi) + 1) / 2)**4
        
        point = rg.Point3d(x-12, y-18, z)
        temp_points.append(point)

# calculate current dimensions
bbox = rg.BoundingBox(temp_points)
current_length = bbox.Max.X - bbox.Min.X
current_width = bbox.Max.Y - bbox.Min.Y
current_height = bbox.Max.Z - bbox.Min.Z

# calculate scale factors
scale_x = length / current_length if current_length > 0 else 1.0
scale_y = width / current_width if current_width > 0 else 1.0
scale_z = height / current_height if current_height > 0 else 1.0

# calculate center for scaling
center = rg.Point3d(0, 0, 0)
for pt in temp_points:
    center += pt
center /= len(temp_points)

# create plane at center for scale transformation
center_plane = rg.Plane(center, rg.Vector3d.ZAxis)
xform_scale = rg.Transform.Scale(center_plane, scale_x, scale_y, scale_z)

# apply transformation and add to datatree
idx = 0
flat_points = []
for ui in range(u_count):
    path = GH_Path(ui)
    for vi in range(v_count):
        pt = rg.Point3d(temp_points[idx])
        pt.Transform(xform_scale)
        points.Add(pt, path)
        flat_points.append(pt)
        idx += 1

# output
surface = rg.NurbsSurface.CreateFromPoints(flat_points, u_count, v_count, 3, 3)
# ---------- end fiocchi_rigati ----------
cluster = Cluster(target=crv, points=fiocchi_rigati.points)

# ---- group: Edges Visibility
panel = Panel("""300
400""")
wires = BrepWireframe(Brep=cluster, Density=-1)
linetype = ModelLinetype(Name="Custom", Segments=panel)  # -> Linetype, Name, Segments, CapStyle, JoinStyle, Width, WidthUnits
curve_preview = CustomCurvePreview(Curve=wires, Linetype=linetype.Linetype, Colour=RGB(0, 0, 0))

# ----
debrep = DeconstructBrep(Brep=cluster)  # -> Faces, Edges, Vertices

mesh_uv = MeshSurface(Surface=debrep.Faces, UCount="1", VCount=Slider(62, range=0..100), Overhang=True, Equalize=False)
pa = PlanarityAnalysis(Mesh=mesh_uv, Max="0.01")  # -> M, P

# ---- group: Data Formatting
lng = ListLength(List=debrep.Faces)
series = Series(Start=0, Step=1, Count=lng)
expression = Expression(x=series, Expression="Format(\"{0:00}\", x)")
concat = Concatenate(FragmentA="Strip ", FragmentB=expression, FragmentC=" -")
list_length = ListLength(List=flatten(crv))

# ---- group: Data / Values
num = Number(pa.P)
abs = Absolute(Value=num)
ma = MassAddition(Input=abs)  # -> Result, PartialResults
shift_paths = ShiftPaths(Data=ma.Result, Offset=-1)
expression_2 = Expression(x=shift_paths, Expression="Round((x*100),1)")

# ---- group: Custom Component to generate color gradient
# GH COLOR TWEEN
# ─────────────────────────────────
# Interpolates between input colours to produce a smooth gradient list.
# 
# INPUTS:
#   colors  - DataTree / List Color  — gradient stop colours per branch
#   count   - Item / List int        — number of output colours
#                                      single value  → applied to every branch
#                                      list / tree   → one per branch
swatch = ColourSwatch(SwatchColor=RGB(237, 130, 173))
tween_colors = TweenColors(InputColors=[swatch, ColourSwatch(SwatchColor=RGB(209, 172, 250))], ColorsCount=list_length)  # -> graft(GradientColors)

# ---- group: Generate groups labels
char_sequence = CharSequence(Count=list_length, CharPool="ABCDEFGHIJKLMNOPQRSTUVWXYZ", Format="{0}")
concat_2 = Concatenate(FragmentA="Surface ", FragmentB=char_sequence)
graft_tree = GraftTree(Tree=concat_2, IncludeEmptyLists=True, IncludeNullItems=True)

# ----
panel_2 = Panel(expression_2)

# ---- group: Custom Component to generate color gradient
# COLOR MAP
# ─────────────────────────────────
# Maps a list of values to gradient colours using a defined domain.
# 
# INPUTS:
#   colors  - DataTree / List Color  — gradient stop colours per branch
#   values  - DataTree / List float  — values to map to colours
#   domain  - Item / List float      — [min, max] domain bounds
#                                      two numbers: explicit min/max
#                                      omit / None: auto-computed from values
construct_domain = ConstructDomain(DomainStart=0, DomainEnd="100")
map_colors = MapColors(
    Colors=[ColourSwatch(SwatchColor=RGB(173, 217, 240)), ColourSwatch(SwatchColor=RGB(170, 133, 212))],
    Values=expression_2,
    Domain=construct_domain)

# ----
preview = CustomPreview(Geometry=debrep.Faces, Material=map_colors)
list = ValueList({"treemap", "pack", "bar", "sunburst", "sankey"}, selected="sunburst")
# DATA TREE TIPS
# ─────────────────────────────────
# Flat list  →  each item is its own segment
#               (no groups)
# 
# DataTree   →  each branch = one group
#               branch name is ignored;
#               use  groups  input for labels
# 
# Mix & match:
#   labels     {0;0}  {0;1}  {0;2}
#   values     {0;0}  {0;1}  {0;2}
#   groups     {0}    {0}    {0}   ← broadcast
#   g_colors   {0}    {0}    {0}   ← one per branch
data_muncher = DataMuncher(
    ChartType=list,
    Labels=concat,
    Values=expression_2,
    Groups=graft_tree,
    ItemColors=map_colors,
    GroupColors=tween_colors,
    ChartTitle="DASHBOARD",
    ChartSubtitle="Panels Deviation",
    Units="%",
    ChartSize=Slider(564, range=0..1000),
    FontScale=Slider(1.448, range=0..2),
    Viewport="Perspective",
    Toggle=Toggle(True))

# ==== cluster Cluster
points = ClusterInput()
flip = FlipMatrix(Data=points)
nurbs = NurbsCurve(Vertices=flip, Degree=3, Periodic=False)  # -> flatten(Curve), Length, Domain
fit_line = FitLine(Points=flatten(points))
target = ClusterInput()
flow = Flow(Geometry=nurbs.Curve, Base=fit_line, Target=target, ReverseBase=False, ReverseTarget=False, Stretch=True, Rigid=False)
loft = Loft(Curves=flow, Options={Adjust=False, Closed=False, LoftEnds=0, LoftSimp=0, LoftType=3, Rebuild=10, Refit=0.01})
surface = ClusterOutput(loft)
