# Grasshopper definition treemap_demo.gh (Grasshopper 1.0.8)
# plug-ins: DataMuncher.Components

pt = Point([<point referenced from the Rhino model> x7])
project = Project(Geometry=pt, Plane=PlaneXY(0, 0, 0))  # -> Geometry, Transform

# ---- group: Network Points
hull = ConvexHull(Points=project.Geometry, Plane=PlaneXY(0, 0, 0))  # -> Hull, HullZ, Indices
voronoi = Voronoi(Points=project.Geometry, BruteForceOverride=False)

# ----
trim = TrimWithRegion(Curve=voronoi, Region=hull.Hull)  # -> Inside, Outside
crv = Curve(flatten(trim.Inside))

# ---- group: Remove only lines based on the number of control points
disc = Discontinuity(Curve=crv, Level=2)  # -> Points, Parameters
lng = ListLength(List=disc.Points)
expression = Expression(x=lng, Expression="x>2")
cull = CullPattern(List=crv, CullPattern=flatten(expression))

# ----
crv_2 = Curve(cull)
explode = Explode(Curve=crv_2, Recursive=True)  # -> flatten(Segments), Vertices
dupln = RemoveDuplicateLines(Lines=explode.Segments, Tolerance=0.01)
cluster = Cluster(lines=dupln, offset=Slider(2, range=0..10))
srf = Surface(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)
flatten = FlattenTree(Tree=cluster, Path="{0}")
pcen = PolygonCenter(Polyline=flatten)  # -> CenterV, CenterE, CenterA
pull = PullPoint(Point=pcen.CenterV, Geometry=srf, ClosestOnly=True)  # -> ClosestPoint, Distance, Index
panel = Panel("1")
ln = Line(StartPoint=pcen.CenterV, EndPoint=pull.ClosestPoint)
divlength = DivideLength(Curve=ln, Length="2.6")  # -> Points, Tangents, Parameters
lng_2 = ListLength(List=divlength.Points)  # -> flatten(Length)
series = Series(Start=0, Step="2.6", Count=lng_2)
Z = UnitZ(Factor=series)
move = Move(Geometry=graft(flatten), Motion=Z)  # -> Geometry, Transform
panel_2 = Panel("""Commercial
Offices
Residential
Residential""")
flip = FlipMatrix(Data=move.Geometry)
long = LongestList(ListA=flip, ListB=graft(panel_2), PaddingMode=4)  # -> ListA, ListB
flip_2 = FlipMatrix(Data=long.ListA)
flip_3 = FlipMatrix(Data=long.ListB)
null = NullItem(Item=flip_2)  # -> NullFlags, InvalidFlags, Description
cull_2 = CullPattern(List=flip_3, CullPattern=invert(null.NullFlags))
clean = CleanTree(RemoveNulls=True, RemoveInvalid=True, RemoveEmpty=False, Tree=flip_2)
tstat = TreeStatistics(Tree=clean)  # -> Paths, Length, Count
data = Data(clean)
series_2 = Series(Start=0, Step=1, Count=tstat.Count)
concat = Concatenate(FragmentA="SP_", FragmentB=series_2)  # -> graft(Result)
lng_3 = ListLength(List=data)
parents = Data(flatten(cull_2))
repeat = RepeatData(Data=concat, Length=lng_3)
curves = Data(clean)
names = Data(flatten(repeat))
curves_2 = Data(flatten(clean))
Z_2 = UnitZ(Factor="2.6")
boundary = BoundarySurfaces(Edges=curves)
swatch = ColourSwatch(SwatchColor=RGBA(196, 126, 100, 128))
area = Area(Geometry=curves_2)  # -> Area, Centroid
extr = Extrude(Base=boundary, Direction=Z_2)
merge = Merge(
    Data1=ColourSwatch(SwatchColor=RGBA(78, 120, 166, 100)),
    Data2=ColourSwatch(SwatchColor=RGBA(242, 143, 44, 100)),
    Data3=ColourSwatch(SwatchColor=RGBA(224, 88, 90, 100)))
preview = CustomPreview(Geometry=extr, Material=merge)
list = ValueList({"treemap", "bar", "pie", "sankey", "sunburst"}, selected="bar")
data_muncher = DataMuncher(
    ChartType=list,
    ParentsDataCategories=parents,
    TheLabelForEachDataItem=names,
    TheNumericValueForEachDataItem=area.Area,
    Units="m²",
    Chart_size=Slider(432, range=0..1000),
    Font_scale=Slider(1.2, range=0.5..3),
    Enable=Toggle(False))

# ==== cluster Cluster
offset = ClusterInput()
lines = ClusterInput()
offset_2 = OffsetCurve(Curve=lines, Distance=expr("-x", offset), Corners=1)
offset_3 = OffsetCurve(Curve=lines, Distance=offset, Corners=1)
end = EndPoints(Curve=offset_3)  # -> Start, End
end_2 = EndPoints(Curve=offset_2)  # -> Start, End
ln = Line(StartPoint=end.Start, EndPoint=end_2.Start)
ln_2 = Line(StartPoint=end.End, EndPoint=end_2.End)
merge = Merge(Data1=offset_3, Data2=ln, Data3=ln_2, Data4=offset_2)
join = JoinCurves(Curves=merge, Preserve=False)
curves = ClusterOutput(join)
