# Grasshopper definition test.gh (Grasshopper 1.0.8)

pt = Point([<point referenced from the Rhino model> x7])
project = Project(Geometry=pt, Plane=PlaneXY(0, 0, 0))  # -> Geometry, Transform

# ---- group: Network Points
hull = ConvexHull(Points=project.Geometry, Plane=PlaneXY(0, 0, 0))  # -> Hull, HullZ, Indices
voronoi = Voronoi(Points=project.Geometry, BruteForceOverride=False)

# ----
trim = TrimWithRegion(Curve=voronoi, Region=hull.Hull)  # -> Inside, Outside
crv = Curve(flatten(trim.Inside))

# ---- group: Remove only lines based on the number of control points
disc = Discontinuity(Curve=crv, Level=2)  # -> Points, Parameters
lng = ListLength(List=disc.Points)
expression = Expression(x=lng, Expression="x>2")
cull = CullPattern(List=crv, CullPattern=flatten(expression))

# ----
crv_2 = Curve(cull)
explode = Explode(Curve=crv_2, Recursive=True)  # -> flatten(Segments), Vertices
dupln = RemoveDuplicateLines(Lines=explode.Segments, Tolerance=0.01)
cluster = Cluster(lines=dupln, offset=Slider(2, range=0..10))
srf = Surface(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)
flatten = FlattenTree(Tree=cluster, Path="{0}")
pcen = PolygonCenter(Polyline=flatten)  # -> CenterV, CenterE, CenterA
pull = PullPoint(Point=pcen.CenterV, Geometry=srf, ClosestOnly=True)  # -> ClosestPoint, Distance, Index
panel = Panel("1")
ln = Line(StartPoint=pcen.CenterV, EndPoint=pull.ClosestPoint)
divlength = DivideLength(Curve=ln, Length="2.6")  # -> Points, Tangents, Parameters
lng_2 = ListLength(List=divlength.Points)  # -> flatten(Length)
series = Series(Start=0, Step="2.6", Count=lng_2)
Z = UnitZ(Factor=series)
move = Move(Geometry=graft(flatten), Motion=Z)  # -> Geometry, Transform
panel_2 = Panel("""Commercial
Offices
Residential
Residential""")
flip = FlipMatrix(Data=move.Geometry)
long = LongestList(ListA=flip, ListB=graft(panel_2), PaddingMode=4)  # -> ListA, ListB
flip_2 = FlipMatrix(Data=long.ListA)
flip_3 = FlipMatrix(Data=long.ListB)
null = NullItem(Item=flip_2)  # -> NullFlags, InvalidFlags, Description
cull_2 = CullPattern(List=flip_3, CullPattern=invert(null.NullFlags))
clean = CleanTree(RemoveNulls=True, RemoveInvalid=True, RemoveEmpty=False, Tree=flip_2)
tstat = TreeStatistics(Tree=clean)  # -> Paths, Length, Count
data = Data(clean)
panel_3 = Panel("""Residential
Commercial
Industrial""")
crv_3 = Curve([<curve referenced from the Rhino model> x15])
series_2 = Series(Start=0, Step=1, Count=tstat.Count)
crv_4 = Curve(crv_3)
concat = Concatenate(FragmentA="SP_", FragmentB=series_2)  # -> graft(Result)
lng_3 = ListLength(List=data)
lng_4 = ListLength(List=crv_4)
area = Area(Geometry=crv_4)  # -> Area, Centroid
parents = Data(flatten(cull_2))
charseq = CharSequence(Count=lng_4, CharPool="ABCDEFGHIJKLMNOPQRSTUVWXYZ", Format="{0}")
repeat = RepeatData(Data=concat, Length=lng_3)
num = Number(area.Area)
curves = Data(clean)
names = Data(flatten(repeat))
curves_2 = Data(flatten(clean))
Z_2 = UnitZ(Factor="2.6")
boundary = BoundarySurfaces(Edges=curves)
concat_2 = Concatenate(FragmentA="Zone-", FragmentB=charseq)
partition = PartitionList(List=concat_2, Size=Slider(6, range=0..10))
long_2 = LongestList(ListA=panel_3, ListB=partition, PaddingMode=3)  # -> flatten(ListA), ListB
swatch = ColourSwatch(SwatchColor=RGBA(196, 126, 100, 128))
area_2 = Area(Geometry=curves_2)  # -> Area, Centroid
extr = Extrude(Base=boundary, Direction=Z_2)
number_slider = Slider(1.5, range=0.5..3)
merge = Merge(
    Data1=ColourSwatch(SwatchColor=RGBA(78, 120, 166, 100)),
    Data2=ColourSwatch(SwatchColor=RGBA(242, 143, 44, 100)),
    Data3=ColourSwatch(SwatchColor=RGBA(224, 88, 90, 100)))
number_slider_2 = Slider(623, range=0..1000)
preview = CustomPreview(Geometry=extr, Material=merge)
toggle = BooleanToggle(True)
list = ValueList({"treemap", "bar", "pie", "sankey", "sunburst"}, selected="bar")
list_2 = ValueList({"treemap", "bar", "pie", "sankey", "sunburst"}, selected="treemap")
panel_4 = Panel("sqm")
data_muncher = Python3Script(
    chart_type=list_2,
    parents=long_2.ListA,
    names=concat_2,
    values=num,
    units="m²",
    chart_size=Slider(432, range=0..1000),
    font_scale=Slider(1.2, range=0.5..3),
    enable=Toggle(False))  # -> out, a; inputs parents: list, names: list, values: list
#   port chart_type: [string] - Type one of: treemap, bar, pie, sunburst, sankey. Defaults to treemap if left blank
#   port parents: Connect a list of strings parallel to names. Leave empty or disconnected for a flat (ungrouped) chart
#   port names: Connect a list of strings, one per row of data. Must match the length of values
#   port values: Connect a list of numbers. Negative and zero values are ignored. Must match the length of names
#   port units: Any string, e.g. m², kg, hrs. Defaults to m²
#   port position_x: Horizontal pixel offset of the overlay image from the left edge of the Rhino viewport. Integer. Defaults to 20
#   port position_y: Vertical pixel offset of the overlay image from the top edge of the Rhino viewport. Integer. Defaults to 60
#   port chart_size: Controls the size of the bitmap inside the Rhino viewport
#   port font_scale: A global multiplier applied to every font size in the chart.
#   port viewport: The name or names of the Rhino viewports that should display the overlay. Connect a text panel with one viewport name per line, e.g. Perspective
#   port enable: Toggles the viewport overlay on or off without stopping the dashboard window
# ---------- data_muncher: Python ----------
"""
Data Muncher - Grasshopper Dashboard Component
Rhino 8 Script Component (Python 3)

INPUTS:
  names      : list[str]   - Row labels. Wire a flat list of text, one per item.
                             Must be the same length as values.
  values     : list[float] - Numeric value for each row. Must match length of names.
                             Zero and negative values are skipped.
  parents    : list[str]   - Optional group tag per row, parallel to names.
                             Items with the same parent are clustered. Leave
                             disconnected for a flat chart. Up to 3 nesting levels.
  chart_type : str         - Chart style. One of: treemap, bar, pie, sunburst, sankey.
                             Defaults to treemap.
  title      : str         - Main heading in the dashboard window.
                             Defaults to "Grasshopper Dashboard".
  subtitle   : str         - Secondary line beneath the title.
                             Defaults to "Live Data Feed".
  units      : str         - Unit suffix on every value (e.g. m², kg, hrs).
                             Defaults to m².
  enable     : bool        - Show or hide the Rhino viewport overlay.
                             Wire a Boolean Toggle. Defaults to True.
  x          : int         - Pixel offset from the left edge of the viewport.
                             Defaults to 20.
  y          : int         - Pixel offset from the top edge of the viewport.
                             Defaults to 60.
  w          : int         - Pixel width of the overlay image. Height scales
                             automatically. Higher = sharper. Defaults to 500.
  font_scale : float       - Multiplier for all chart text sizes.
                             1.0 = default, 1.5 = larger, 0.8 = smaller.
  viewport   : str|list    - Rhino viewport name(s) to stamp with the overlay.
                             One name per line for multiple viewports.
                             Defaults to Perspective.
  trigger    : object      - Wire any changing value (button, timer) to force a
                             viewport redraw. The value itself is ignored.

OUTPUTS:
  a          : str         - Status message
"""

a = "initializing..."

_PFX = "DMUNCH_"
_WEB_ASSETS = ("index.html", "d3.min.js", "d3-sankey.min.js")

try:
    import json, os, datetime, threading, traceback, shutil, tempfile
    import scriptcontext as sc
    import Rhino
    import Rhino.Display as rd
    import System.Drawing as sd
    import System.IO
    import System
    from http.server import HTTPServer, SimpleHTTPRequestHandler
except Exception as ex:
    a = "IMPORT ERROR: " + str(ex)
    raise


def _get_pkg_dir():
    roots = []
    try:
        import Grasshopper
        for lib in Grasshopper.Instances.ComponentServer.Libraries:
            if "data_muncher" in lib.Name.lower() or "datamuncher" in lib.Name.lower():
                roots.append(os.path.dirname(lib.Location))
                break
    except Exception:
        pass
    try:
        asm = ghenv.Component.GetType().Assembly.Location
        if asm:
            roots.append(os.path.dirname(asm))
    except Exception:
        pass
    for root in roots:
        for sub in ("shared", "web", ""):
            check = os.path.join(root, sub) if sub else root
            if os.path.isfile(os.path.join(check, "index.html")):
                return check
    return os.getcwd()


def _ensure_work_dir(port):
    work = os.path.join(tempfile.gettempdir(), "data-muncher", str(port))
    os.makedirs(work, exist_ok=True)
    pkg = _get_pkg_dir()
    for fname in _WEB_ASSETS:
        src = os.path.join(pkg, fname)
        dst = os.path.join(work, fname)
        if os.path.isfile(src):
            if not os.path.isfile(dst) or os.path.getmtime(src) > os.path.getmtime(dst):
                shutil.copy2(src, dst)
    return work


try:
    g = globals()
    _names      = g.get("names")      or []
    _values     = g.get("values")     or []
    _parents    = g.get("parents")    or []
    _chart_type = str(g.get("chart_type") or "treemap").lower()
    _title      = str(g.get("title")      or "Grasshopper Dashboard")
    _subtitle   = str(g.get("subtitle")   or "Live Data Feed")
    _units      = str(g.get("units")      or "m²")
    _font_scale = float(g.get("font_scale") or 1.0)
    _enable     = bool(g.get("enable")) if g.get("enable") is not None else True
    _x          = int(g.get("x") or 20)
    _y          = int(g.get("y") or 60)
    _w          = int(g.get("w") or 500)

    # viewport: None → ["Perspective"], single str, or list of str
    # When the GH parameter is in Item Access mode and a multiline list is
    # connected, this script runs once per item.  Accumulate across iterations
    # so every name is included; reset only on the first iteration (index 0).
    _vp_raw = g.get("viewport")
    if not _vp_raw:
        _new_vp = {"Perspective"}
    elif isinstance(_vp_raw, str):
        _new_vp = {_vp_raw.strip()} if _vp_raw.strip() else {"Perspective"}
    else:
        _new_vp = {str(v).strip() for v in _vp_raw if v}

    _iter = getattr(ghenv.Component, "IterationCount", 0)
    if _iter == 0:
        _viewports = _new_vp
    else:
        _viewports = sc.sticky.get(_PFX + "VIEWPORTS", set()) | _new_vp

    sc.sticky[_PFX + "VIEWPORTS"] = _viewports

    if _PFX + "PORT" not in sc.sticky:
        import socket as _sock
        with _sock.socket() as _s:
            _s.bind(('', 0))
            sc.sticky[_PFX + "PORT"] = _s.getsockname()[1]
    PORT = sc.sticky[_PFX + "PORT"]
    URL  = "http://127.0.0.1:{}".format(PORT)

    # DEV MODE: serve directly from repo web folder
    WORK_DIR    = r"C:\Users\Hesham.Shawqy\OneDrive - Grimshaw Architects\Documents\GitHub\data_muncher\web"
    # WORK_DIR    = _ensure_work_dir(PORT)
    OUTPUT_JSON = os.path.join(WORK_DIR, "gh_dashboard.json")

    sc.sticky[_PFX + "ENABLED"] = _enable
    sc.sticky[_PFX + "X"]       = _x
    sc.sticky[_PFX + "Y"]       = _y
    sc.sticky[_PFX + "W"]       = _w

    if _PFX + "LOCK" not in sc.sticky:
        sc.sticky[_PFX + "LOCK"] = threading.Lock()
    _lock = sc.sticky[_PFX + "LOCK"]

    if _PFX + "STARTED" not in sc.sticky:
        _serve_dir = WORK_DIR

        class _H(SimpleHTTPRequestHandler):
            def __init__(self, *a, **kw):
                super().__init__(*a, directory=_serve_dir, **kw)
            def do_POST(self):
                if self.path == "/screenshot":
                    n = int(self.headers.get("Content-Length", 0))
                    data = self.rfile.read(n)
                    with _lock:
                        sc.sticky[_PFX + "PNG_BYTES"]    = data
                        sc.sticky[_PFX + "NEEDS_REDRAW"] = True
                    self.send_response(200)
                    self.end_headers()
                else:
                    self.send_response(404)
                    self.end_headers()
            def end_headers(self):
                self.send_header("Cache-Control", "no-cache, no-store, must-revalidate")
                super().end_headers()
            def log_message(self, *a):
                pass

        _httpd = HTTPServer(("127.0.0.1", PORT), _H)
        threading.Thread(target=_httpd.serve_forever, daemon=True).start()

        import Eto.Forms as ef, Eto.Drawing as ed
        _wv           = ef.WebView()
        _form         = ef.Form()
        _form.Title   = "Data Muncher"
        _form.Size    = ed.Size(1100, 750)
        _form.Topmost = True
        _form.Content = _wv

        def _on_loaded(sender, e):
            try:
                _wv.ExecuteScript("window.__GH_PORT={}".format(PORT))
            except Exception:
                pass
        _wv.DocumentLoaded += _on_loaded

        _wv.Url = System.Uri(URL)

        def _on_closing(sender, e):
            e.Cancel = True          # don't destroy – just hide so WebView keeps running
            _form.Visible = False
        _form.Closing += _on_closing

        _form.Show()

        sc.sticky[_PFX + "STARTED"] = True
        sc.sticky[_PFX + "FORM"]    = _form
        Rhino.RhinoApp.WriteLine("[DataMuncher] Ready on port {}".format(PORT))

    # Re-show the form on every component run so that reset / re-compute brings it back
    _frm = sc.sticky.get(_PFX + "FORM")
    if _frm is not None and _enable:
        _frm.Visible = True

    if _PFX + "IDLE" not in sc.sticky:
        def _idle(sender, e):
            needs = False
            data  = None
            with sc.sticky.get(_PFX + "LOCK", threading.Lock()):
                if sc.sticky.get(_PFX + "NEEDS_REDRAW"):
                    sc.sticky[_PFX + "NEEDS_REDRAW"] = False
                    needs = True
                    data  = sc.sticky.get(_PFX + "PNG_BYTES")
            if needs and data:
                try:
                    ms  = System.IO.MemoryStream(System.Array[System.Byte](data))
                    raw = sd.Bitmap(ms)
                    old = sc.sticky.get(_PFX + "BMP")
                    if old:
                        try: old.Dispose()
                        except Exception: pass
                    sc.sticky[_PFX + "BMP"] = rd.DisplayBitmap(sd.Bitmap(raw))
                    raw.Dispose()
                    ms.Dispose()
                except Exception as ex:
                    sc.sticky[_PFX + "ERR"] = str(ex)
                Rhino.RhinoDoc.ActiveDoc.Views.Redraw()

        Rhino.RhinoApp.Idle += _idle
        sc.sticky[_PFX + "IDLE"] = _idle

    if _PFX + "CH" not in sc.sticky:
        def _draw(sender, e):
            if not sc.sticky.get(_PFX + "ENABLED", True):
                return
            vps = sc.sticky.get(_PFX + "VIEWPORTS", {"Perspective"})
            if e.Display.Viewport.Name not in vps:
                return
            try:
                bmp = sc.sticky.get(_PFX + "BMP")
                if bmp:
                    e.Display.DrawBitmap(
                        bmp,
                        sc.sticky.get(_PFX + "X", 20),
                        sc.sticky.get(_PFX + "Y", 60),
                    )
            except Exception as ex:
                sc.sticky[_PFX + "ERR"] = str(ex)

        rd.DisplayPipeline.DrawForeground += _draw
        sc.sticky[_PFX + "CH"] = _draw

    if _names and _values and len(_names) == len(_values):
        _parents = (_parents + [""] * len(_names))[:len(_names)]
        rows = [
            {"name": str(n), "value": float(v), **({"parent": str(p)} if p else {})}
            for n, v, p in zip(_names, _values, _parents)
            if n is not None and v is not None
        ]
        _config = {
            "type":       _chart_type,
            "title":      _title,
            "subtitle":   _subtitle,
            "units":      _units,
            "w":          _w,
            "font_scale": _font_scale,
        }
        _sig = json.dumps({"c": _config, "d": rows}, sort_keys=True)
        if _sig != sc.sticky.get(_PFX + "SIG"):
            sc.sticky[_PFX + "SIG"] = _sig
            payload = {
                "updated": datetime.datetime.now().strftime("%Y-%m-%d %H:%M:%S"),
                "config": _config,
                "data": rows,
            }
            with open(OUTPUT_JSON, "w") as f:
                json.dump(payload, f, indent=2)
        a = "OK | {} rows | {} | overlay:{}".format(
            len(rows), _chart_type.upper(), "ON" if _enable else "OFF"
        )
    else:
        a = "waiting for data..."

except Exception:
    a = "ERROR: " + traceback.format_exc()
    Rhino.RhinoApp.WriteLine("[DataMuncher] " + a)
# ---------- end data_muncher ----------

# ==== cluster Cluster
offset = ClusterInput()
lines = ClusterInput()
offset_2 = OffsetCurve(Curve=lines, Distance=expr("-x", offset), Corners=1)
offset_3 = OffsetCurve(Curve=lines, Distance=offset, Corners=1)
end = EndPoints(Curve=offset_3)  # -> Start, End
end_2 = EndPoints(Curve=offset_2)  # -> Start, End
ln = Line(StartPoint=end.Start, EndPoint=end_2.Start)
ln_2 = Line(StartPoint=end.End, EndPoint=end_2.End)
merge = Merge(Data1=offset_3, Data2=ln, Data3=ln_2, Data4=offset_2)
join = JoinCurves(Curves=merge, Preserve=False)
curves = ClusterOutput(join)
